# Grasshopper definition simple_cantilever_transformation[completed].gh (Grasshopper 1.0.7)
# plug-ins: Libra

crv = Curve(<curve referenced from the Rhino model>)
pt = Point(<point referenced from the Rhino model>)
pt_2 = Point(<point referenced from the Rhino model>)
pt_3 = Point(<point referenced from the Rhino model>)
pt_4 = Point(<point referenced from the Rhino model>)
pt_5 = Point(<point referenced from the Rhino model>)
pt_6 = Point(<point referenced from the Rhino model>)
vec2pt = Vector2Pt(PointA=pt, PointB=pt_2, Unitize=False)  # -> Vector, Length
vec2pt_2 = Vector2Pt(PointA=pt_3, PointB=pt_4, Unitize=False)  # -> Vector, Length
vec2pt_3 = Vector2Pt(PointA=pt_5, PointB=pt_6, Unitize=False)  # -> Vector, Length
constructdomain = ConstructDomain(RegionsIn=crv)
merge = Merge(Data1=pt_2, Data2=pt_3, Data3=pt_6)
merge_2 = Merge(Data1=vec2pt.Vector, Data2=vec2pt_2.Vector, Data3=vec2pt_3.Vector)
constructmodel = ConstructModel(AnchorNode=merge, ForceVector=merge_2, DesignDomain=constructdomain)

force_s_selection_rule = ValueList({"Random": 0, "ProximityToUserSelectedPoint": 1, "MinMagnitude": 2, "MaxMagnitude": 3, "Oldest": 4, "Newest": 5, "Closest": 6, "Furthest": 7, "ClosestToDomainCentroid": 8, "FurthestToDomainCentroid": 9, "ClosestToPtCloud": 10, "FurthestToPtCloud": 11}, selected="Closest")
force_indeterminacies_rule = ValueList({"Random": 0, "UserDefinedMagnitude": 1}, selected="UserDefinedMagnitude")
node_placement_rule = ValueList({"Random": 0, "UserSelectedParam": 1, "UserSelectedPt": 2}, selected="UserSelectedParam")
topological_configuration = ValueList({"Inbetween": 0, "Peripheral": 1}, selected="Inbetween")
genes = GenePool(Decimals=2, Maximum=10, Minimum=-10, Value=[9.14, -5.23, -0.22])
type_of_force_set = ValueList({"Monomial": 0, "Binomial": 1}, selected="Binomial")
forcesrule = ConstructForceSelectionRule(
    ForceSelectionRuleID=force_s_selection_rule,
    TypeOfForceSet=type_of_force_set,
    TopologicalConfiguration=topological_configuration,
    FlipForcesOrder=Toggle(False))
nodeprule = ConstructNodePlacementRule(NodePlacementRuleID=node_placement_rule, MinDistanceToModel=Slider(0.25, range=0..1), TParam=Slider(0.797, range=0..1))
forceirule = ConstructForceIndeterminaciesRule(ForceIndeterminaciesRuleID=force_indeterminacies_rule, Forces=genes)
entropy_rate = ValueList({"Convergence": -1, "Stagnation": 0, "Divergence": 1}, selected="Stagnation")
policy = ConstructTransformationPolicy(
    EntropyRate=entropy_rate,
    ForceSelectionRuleForcesSet=forcesrule,
    NodePlacementRulePoint=nodeprule,
    ForceIndeterminaciesRuleAxialForces=forceirule)
transform = ApplyTransformationPolicy(Execute=Toggle(True), Iterations=Slider(1, range=1..10), Model=constructmodel, Policy=policy)

force_s_selection_rule_2 = ValueList({"Random": 0, "ProximityToUserSelectedPoint": 1, "MinMagnitude": 2, "MaxMagnitude": 3, "Oldest": 4, "Newest": 5, "Closest": 6, "Furthest": 7, "ClosestToDomainCentroid": 8, "FurthestToDomainCentroid": 9, "ClosestToPtCloud": 10, "FurthestToPtCloud": 11}, selected="Closest")
force_indeterminacies_rule_2 = ValueList({"Random": 0, "UserDefinedMagnitude": 1}, selected="UserDefinedMagnitude")
node_placement_rule_2 = ValueList({"Random": 0, "UserSelectedParam": 1, "UserSelectedPt": 2}, selected="UserSelectedParam")
topological_configuration_2 = ValueList({"Inbetween": 0, "Peripheral": 1}, selected="Inbetween")
genes_2 = GenePool(Decimals=2, Maximum=10, Minimum=-10, Value=[-4.33, -5.23, -0.22])
type_of_force_set_2 = ValueList({"Monomial": 0, "Binomial": 1}, selected="Binomial")
forcesrule_2 = ConstructForceSelectionRule(
    ForceSelectionRuleID=force_s_selection_rule_2,
    TypeOfForceSet=type_of_force_set_2,
    TopologicalConfiguration=topological_configuration_2,
    FlipForcesOrder=Toggle(False))
nodeprule_2 = ConstructNodePlacementRule(NodePlacementRuleID=node_placement_rule_2, MinDistanceToModel=Slider(0.25, range=0..1), TParam=Slider(0.386, range=0..1))
forceirule_2 = ConstructForceIndeterminaciesRule(ForceIndeterminaciesRuleID=force_indeterminacies_rule_2, Forces=genes_2)
entropy_rate_2 = ValueList({"Convergence": -1, "Stagnation": 0, "Divergence": 1}, selected="Convergence")
policy_2 = ConstructTransformationPolicy(
    EntropyRate=entropy_rate_2,
    ForceSelectionRuleForcesSet=forcesrule_2,
    NodePlacementRulePoint=nodeprule_2,
    ForceIndeterminaciesRuleAxialForces=forceirule_2)
transform_2 = ApplyTransformationPolicy(Execute=Toggle(True), Iterations=Slider(5, range=1..10), Model=transform, Policy=policy_2)

genes_3 = GenePool(Decimals=2, Maximum=5, Minimum=0, Value=[1.5, 2, 1, 0.7, 1.5, 2, 2, 1.5])
pt_7 = Point(Point(35, 0, 0))
xy = XYPlane(Origin=pt_7)
modelhistory = ModelHistory(Model=transform_2, Iteration=-1)  # -> ForceSelectionRule, NodePlacementRule, ForceIndeterminaciesRule, EntropyRate, ForceSet, IntroducedPoint, ForceMagnitudes, ForceVectors
modelmetrics = ModelMetricsText(Model=transform_2)  # -> AllMetrics, StaticAction, NumberOfBars, NumberOfNodes, NumberOfIntersectingBars, NumberOfInterimForces, MinBarLength, MaxBarLength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
modelspidergraph = ModelMetricsSpiderGraph(
    Model=transform_2,
    GraphPlane=xy,
    GraphWeight=genes_3,
    GraphScale=1,
    TextHeight=Slider(0.5, range=0..1),
    VerticalDistance=Slider(0.561, range=0..1),
    RadialDistance=Slider(0.309, range=0..1))  # -> GraphLines, MetricsLine, Text
panel = Panel(modelhistory.EntropyRate)
panel_2 = Panel(modelmetrics.AllMetrics)
pipe = Pipe(Curve=modelspidergraph.MetricsLine, Radius=Slider(0.119, range=0..1), Caps=0)
