# Grasshopper definition arch_bridge_transformation[empty].gh (Grasshopper 1.0.7)
# plug-ins: Libra

crv = Curve(<curve referenced from the Rhino model>)
pt = Point(<point referenced from the Rhino model>)
pt_2 = Point(<point referenced from the Rhino model>)
pt_3 = Point(<point referenced from the Rhino model>)
pt_4 = Point(<point referenced from the Rhino model>)
pt_5 = Point(<point referenced from the Rhino model>)
pt_6 = Point(<point referenced from the Rhino model>)
pt_7 = Point(<point referenced from the Rhino model>)
pt_8 = Point(<point referenced from the Rhino model>)
pt_9 = Point(<point referenced from the Rhino model>)
pt_10 = Point(<point referenced from the Rhino model>)
pt_11 = Point(<point referenced from the Rhino model>)
pt_12 = Point(<point referenced from the Rhino model>)
pt_13 = Point(<point referenced from the Rhino model>)
pt_14 = Point(<point referenced from the Rhino model>)
pt_15 = Point(<point referenced from the Rhino model>)
pt_16 = Point(<point referenced from the Rhino model>)
pt_17 = Point(<point referenced from the Rhino model>)
pt_18 = Point(<point referenced from the Rhino model>)
vec2pt = Vector2Pt(PointA=pt, PointB=pt_2, Unitize=False)  # -> Vector, Length
vec2pt_2 = Vector2Pt(PointA=pt_3, PointB=pt_4, Unitize=False)  # -> Vector, Length
vec2pt_3 = Vector2Pt(PointA=pt_5, PointB=pt_6, Unitize=False)  # -> Vector, Length
vec2pt_4 = Vector2Pt(PointA=pt_7, PointB=pt_8, Unitize=False)  # -> Vector, Length
vec2pt_5 = Vector2Pt(PointA=pt_9, PointB=pt_10, Unitize=False)  # -> Vector, Length
vec2pt_6 = Vector2Pt(PointA=pt_11, PointB=pt_12, Unitize=False)  # -> Vector, Length
vec2pt_7 = Vector2Pt(PointA=pt_13, PointB=pt_14, Unitize=False)  # -> Vector, Length
vec2pt_8 = Vector2Pt(PointA=pt_15, PointB=pt_16, Unitize=False)  # -> Vector, Length
vec2pt_9 = Vector2Pt(PointA=pt_17, PointB=pt_18, Unitize=False)  # -> Vector, Length
constructdomain = ConstructDomain(RegionsIn=crv)
merge = Merge(Data1=pt_2, Data2=pt_4, Data3=pt_6, Data4=pt_8, Data5=pt_10, Data6=pt_12, Data7=pt_14, Data8=pt_16, Data9=pt_18)
merge_2 = Merge(
    Data1=vec2pt.Vector,
    Data2=vec2pt_2.Vector,
    Data3=vec2pt_3.Vector,
    Data4=vec2pt_4.Vector,
    Data5=vec2pt_5.Vector,
    Data6=vec2pt_6.Vector,
    Data7=vec2pt_7.Vector,
    Data8=vec2pt_8.Vector,
    Data9=vec2pt_9.Vector)
constructmodel = ConstructModel(AnchorNode=merge, ForceVector=merge_2, DesignDomain=constructdomain)
