# Grasshopper definition symmetric_pylon_transformation[iga].gh (Grasshopper 1.0.7)
# plug-ins: Libra

pt = Point(<point referenced from the Rhino model>)
pt_2 = Point(<point referenced from the Rhino model>)
pt_3 = Point(<point referenced from the Rhino model>)
pt_4 = Point(<point referenced from the Rhino model>)
pt_5 = Point(<point referenced from the Rhino model>)
pt_6 = Point(<point referenced from the Rhino model>)
pt_7 = Point(<point referenced from the Rhino model>)
pt_8 = Point(<point referenced from the Rhino model>)
pt_9 = Point(<point referenced from the Rhino model>)
pt_10 = Point(<point referenced from the Rhino model>)
pt_11 = Point(<point referenced from the Rhino model>)
pt_12 = Point(<point referenced from the Rhino model>)
pt_13 = Point(<point referenced from the Rhino model>)
pt_14 = Point(<point referenced from the Rhino model>)
pt_15 = Point(<point referenced from the Rhino model>)
pt_16 = Point(<point referenced from the Rhino model>)
vec2pt = Vector2Pt(PointA=pt, PointB=pt_2, Unitize=False)  # -> Vector, Length
vec2pt_2 = Vector2Pt(PointA=pt_3, PointB=pt_4, Unitize=False)  # -> Vector, Length
vec2pt_3 = Vector2Pt(PointA=pt_5, PointB=pt_6, Unitize=False)  # -> Vector, Length
vec2pt_4 = Vector2Pt(PointA=pt_7, PointB=pt_8, Unitize=False)  # -> Vector, Length
vec2pt_5 = Vector2Pt(PointA=pt_9, PointB=pt_10, Unitize=False)  # -> Vector, Length
vec2pt_6 = Vector2Pt(PointA=pt_11, PointB=pt_12, Unitize=False)  # -> Vector, Length
vec2pt_7 = Vector2Pt(PointA=pt_13, PointB=pt_14, Unitize=False)  # -> Vector, Length
vec2pt_8 = Vector2Pt(PointA=pt_15, PointB=pt_16, Unitize=False)  # -> Vector, Length
crv = Curve(<curve referenced from the Rhino model>)
builddomain = BuildDomain(RegionsIn=crv)
merge = Merge(Data1=pt_2, Data2=pt_4, Data3=pt_6, Data4=pt_8, Data5=pt_10, Data6=pt_12, Data7=pt_14, Data8=pt_16)
merge_2 = Merge(
    Data1=vec2pt.Vector,
    Data2=vec2pt_2.Vector,
    Data3=vec2pt_3.Vector,
    Data4=vec2pt_4.Vector,
    Data5=vec2pt_5.Vector,
    Data6=vec2pt_6.Vector,
    Data7=vec2pt_7.Vector,
    Data8=vec2pt_8.Vector)
buildmodel = BuildModelWithVectors(AnchorNode=merge, ForceVector=merge_2, DesignDomain=builddomain)
force_indeterminacies_rule = ValueList({"Random": 0, "UserDefinedMagnitude": 1}, selected="UserDefinedMagnitude")
node_placement_rule = ValueList({"Random": 0, "UserSelectedParam": 1, "UserSelectedPt": 2}, selected="UserSelectedParam")
topological_configuration = ValueList({"Inbetween": 0, "Peripheral": 1}, selected="Inbetween")
genes = GenePool(
    Decimals=0,
    Maximum=11,
    Minimum=2,
    Value=[5.746878869, 10.64030711, 4.268421881, 5.26056754, 9.728186983, 8.733741164, 5.863538853, 6.906262244, 8.673404234, 4.153436848, 5.011208007, 8.127065347, 10.48285463, 6.637022642, 2.333157935, 2.670756174, 6.356710685, 9.193770493, 8.283929308, 9.525223066])
genes_2 = GenePool(
    Decimals=0,
    Maximum=1,
    Minimum=0,
    Value=[0.01152282201, 0.0321521458, 0.6747697241, 0.3405441674, 0.4992000296, 0.5964891245, 0.7015952843, 0.3188211009, 0.3910416347, 0.09420028177, 0.448272279, 0.9102103713, 0.7577671342, 0.2570730875, 0.8971214306, 0.6188381943, 0.8922172214, 0.5968487493, 0.6659586885, 0.2772517282])
genes_3 = GenePool(
    Decimals=4,
    Maximum=1,
    Minimum=0,
    Value=[0.6962106391, 0.4082487405, 0.9071598874, 0.4399605512, 0.03899919999, 0.5789888755, 0.5601343382, 0.2428379844, 0.5731577405, 0.5462757221, 0.1317849524, 0.9986811659, 0.5960248633, 0.4695059163, 0.8425289371, 0.5041604006, 0.2732907754, 0.626350533, 0.6806059103, 0.5708556323])
genes_4 = GenePool(
    Decimals=2,
    Maximum=10,
    Minimum=-10,
    Value=[-6.266132238, 4.90045007, 2.303577481, 6.989060764, 0.7039433567, 3.939533454, 9.724482262, 6.5758902, -3.29629028, 9.964451874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])
type_of_force_set = ValueList({"Monomial": 0, "Binomial": 1}, selected="Binomial")
python = GhPythonScript(x=genes_2)  # -> out, bool; inputs x: list
# ---------- python: Python ----------
bool = []
for val in x:
    if val == 0:
        bool.append(False)
    else:
        bool.append(True)
print bool
# ---------- end python ----------
forcesrule = ConstructForceSelectionRule(
    ForceSelectionRuleID=genes,
    TypeOfForceSet=type_of_force_set,
    TopologicalConfiguration=topological_configuration,
    FlipForcesOrder=python.bool)
nodeprule = ConstructNodePlacementRule(NodePlacementRuleID=node_placement_rule, MinDistanceToModel=Slider(0.25, range=0..1), TParam=genes_3)
forceirule = ConstructForceIndeterminaciesRule(ForceIndeterminaciesRuleID=force_indeterminacies_rule, Forces=genes_4)
panel = Panel(forcesrule)
panel_2 = Panel(nodeprule)
panel_3 = Panel(forceirule)
entropy_rate = ValueList({"Convergence": -1, "Stagnation": 0, "Divergence": 1}, selected="Convergence")
policy = ConstructTransformationPolicy(
    EntropyRate=entropy_rate,
    ForceSelectionRuleForcesSet=forcesrule,
    NodePlacementRulePoint=nodeprule,
    ForceIndeterminaciesRuleAxialForces=forceirule)
panel_4 = Panel(policy)
pt_17 = Point(<point referenced from the Rhino model>)
transform = ApplyTransformationPolicy(Execute=Toggle(True), Iterations=Slider(20, range=1..20), Model=buildmodel, Policy=policy)
yz = YZPlane(Origin=pt_17)
modelgeometry = ModelGeometry(Model=transform, MirrorPlane=yz, NodalRadius=Slider(0.25, range=0..3), ForcesScale=Slider(1, range=0..3))  # -> forces_ext, forces_int, bars_compression, bars_tension, nodes
modelmetrics = ModelMetricsText(Model=transform)  # -> AllMetrics, StaticAction, NumberOfBars, NumberOfNodes, NumberOfIntersectingBars, NumberOfInterimForces, MinBarLength, MaxBarLength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
modelhistory = ModelHistory(Model=transform, Iteration=-1)  # -> ForceSelectionRule, NodePlacementRule, ForceIndeterminaciesRule, EntropyRate, ForceSet, IntroducedPoint, ForceMagnitudes, ForceVectors
bar_intersections = Panel(modelmetrics.NumberOfIntersectingBars)
panel_5 = Panel(modelhistory.ForceSelectionRule)
panel_6 = Panel(modelhistory.NodePlacementRule)
panel_7 = Panel(modelhistory.EntropyRate)
panel_8 = Panel(modelmetrics.AllMetrics)
bars = Panel(modelmetrics.NumberOfBars)
interim_forces = Panel(modelmetrics.NumberOfInterimForces)
dse_iga = DesignSpaceExploration(
    GenomeS=[genes, genes_2, genes_3, genes_4],
    Model=transform,
    ObjectiveS=[modelmetrics.NumberOfBars, modelmetrics.NumberOfInterimForces, modelmetrics.NumberOfIntersectingBars])
