# Grasshopper definition symmetric_pylon_transformation[completed].gh (Grasshopper 1.0.7)
# plug-ins: Libra

crv = Curve(<curve referenced from the Rhino model>)
builddomain = BuildDomain(RegionsIn=crv)

pt = Point(<point referenced from the Rhino model>)
pt_2 = Point(<point referenced from the Rhino model>)
pt_3 = Point(<point referenced from the Rhino model>)
pt_4 = Point(<point referenced from the Rhino model>)
pt_5 = Point(<point referenced from the Rhino model>)
pt_6 = Point(<point referenced from the Rhino model>)
pt_7 = Point(<point referenced from the Rhino model>)
pt_8 = Point(<point referenced from the Rhino model>)
pt_9 = Point(<point referenced from the Rhino model>)
pt_10 = Point(<point referenced from the Rhino model>)
pt_11 = Point(<point referenced from the Rhino model>)
pt_12 = Point(<point referenced from the Rhino model>)
pt_13 = Point(<point referenced from the Rhino model>)
pt_14 = Point(<point referenced from the Rhino model>)
pt_15 = Point(<point referenced from the Rhino model>)
pt_16 = Point(<point referenced from the Rhino model>)
vec2pt = Vector2Pt(PointA=pt, PointB=pt_2, Unitize=False)  # -> Vector, Length
vec2pt_2 = Vector2Pt(PointA=pt_3, PointB=pt_4, Unitize=False)  # -> Vector, Length
vec2pt_3 = Vector2Pt(PointA=pt_5, PointB=pt_6, Unitize=False)  # -> Vector, Length
vec2pt_4 = Vector2Pt(PointA=pt_7, PointB=pt_8, Unitize=False)  # -> Vector, Length
vec2pt_5 = Vector2Pt(PointA=pt_9, PointB=pt_10, Unitize=False)  # -> Vector, Length
vec2pt_6 = Vector2Pt(PointA=pt_11, PointB=pt_12, Unitize=False)  # -> Vector, Length
vec2pt_7 = Vector2Pt(PointA=pt_13, PointB=pt_14, Unitize=False)  # -> Vector, Length
vec2pt_8 = Vector2Pt(PointA=pt_15, PointB=pt_16, Unitize=False)  # -> Vector, Length
merge = Merge(Data1=pt_2, Data2=pt_4, Data3=pt_6, Data4=pt_8, Data5=pt_10, Data6=pt_12, Data7=pt_14, Data8=pt_16)
merge_2 = Merge(
    Data1=vec2pt.Vector,
    Data2=vec2pt_2.Vector,
    Data3=vec2pt_3.Vector,
    Data4=vec2pt_4.Vector,
    Data5=vec2pt_5.Vector,
    Data6=vec2pt_6.Vector,
    Data7=vec2pt_7.Vector,
    Data8=vec2pt_8.Vector)
buildmodel = BuildModelWithVectors(AnchorNode=merge, ForceVector=merge_2, DesignDomain=builddomain)

force_indeterminacies_rules = ValueList({"Random": 0, "UserDefinedMagnitude": 1}, selected="UserDefinedMagnitude")
node_placement_rules = ValueList({"Random": 0, "UserSelectedParam": 1, "UserSelectedPt": 2}, selected="UserSelectedParam")
selectforce = SelectForce(Model=buildmodel, Identifier=Slider(0.177, range=0..1))  # -> ForceObject, ForceName, AnchorNodeObject, ForceDirection, ForceMagnitude
selectforce_2 = SelectForce(Model=buildmodel, Identifier=Slider(0.06, range=0..1))  # -> ForceObject, ForceName, AnchorNodeObject, ForceDirection, ForceMagnitude
genes = GenePool(Decimals=2, Maximum=10, Minimum=-10, Value=[3.27, -0.1641388844, 4.296032532])
number_slider = Slider(0.743, range=0..1)
candidate_configuration = ValueList({"Inbetween": 0, "Peripheral": 1, "Central": 2}, selected="Inbetween")
entropy_rate_policies = ValueList({"Converge": -1, "Stagnate": 0, "Diverge": 1}, selected="Stagnate")
nodeprule = ConstructNodePlacementRule(NodePlacementRuleID=node_placement_rules, MinDistanceToModel=Slider(0.25, range=0..1))
forceirule = ConstructForceIndeterminaciesRule(ForceIndeterminaciesRuleID=force_indeterminacies_rules)
constructforceset = ConstructForceSet(
    EntropyRate=entropy_rate_policies,
    Configuration=candidate_configuration,
    ModelWithDomain=buildmodel,
    Forces=[selectforce.ForceObject, selectforce_2.ForceObject])  # -> IsValid, ForceSet, EntropyRateDomain, ConstructabilityDomain
policy = ConstructTransformationPolicy(
    EntropyRate=entropy_rate_policies,
    ForceSelectionRuleForcesSet=constructforceset.ForceSet,
    NodePlacementRulePoint=nodeprule,
    ForceIndeterminaciesRuleAxialForces=forceirule)
transform = ApplyTransformationPolicy(Execute=Toggle(True), Iterations=Slider(1, range=1..10), Model=buildmodel, Policy=policy)

force_indeterminacies_rules_2 = ValueList({"Random": 0, "UserDefinedMagnitude": 1}, selected="UserDefinedMagnitude")
node_placement_rules_2 = ValueList({"Random": 0, "UserSelectedParam": 1, "UserSelectedPt": 2}, selected="UserSelectedParam")
genes_2 = GenePool(Decimals=2, Maximum=10, Minimum=-10, Value=[4.07, -0.1641388844, 4.296032532])
number_slider_2 = Slider(0.62, range=0..1)
selectforce_3 = SelectForce(Model=transform, Identifier=Slider(0, range=0..1))  # -> ForceObject, ForceName, AnchorNodeObject, ForceDirection, ForceMagnitude
selectforce_4 = SelectForce(Model=transform, Identifier=Slider(1, range=0..1))  # -> ForceObject, ForceName, AnchorNodeObject, ForceDirection, ForceMagnitude
nodeprule_2 = ConstructNodePlacementRule(NodePlacementRuleID=node_placement_rules_2, MinDistanceToModel=Slider(0.25, range=0..1))
forceirule_2 = ConstructForceIndeterminaciesRule(ForceIndeterminaciesRuleID=force_indeterminacies_rules_2)
candidate_configuration_2 = ValueList({"Inbetween": 0, "Peripheral": 1, "Central": 2}, selected="Inbetween")
entropy_rate_policies_2 = ValueList({"Converge": -1, "Stagnate": 0, "Diverge": 1}, selected="Converge")
constructforceset_2 = ConstructForceSet(
    EntropyRate=entropy_rate_policies_2,
    Configuration=candidate_configuration_2,
    ModelWithDomain=transform,
    Forces=[selectforce_3.ForceObject, selectforce_4.ForceObject])  # -> IsValid, ForceSet, EntropyRateDomain, ConstructabilityDomain
policy_2 = ConstructTransformationPolicy(
    EntropyRate=entropy_rate_policies_2,
    ForceSelectionRuleForcesSet=constructforceset_2.ForceSet,
    NodePlacementRulePoint=nodeprule_2,
    ForceIndeterminaciesRuleAxialForces=forceirule_2)
transform_2 = ApplyTransformationPolicy(Execute=Toggle(True), Iterations=Slider(1, range=1..10), Model=transform, Policy=policy_2)

force_indeterminacies_rules_3 = ValueList({"Random": 0, "UserDefinedMagnitude": 1}, selected="UserDefinedMagnitude")
node_placement_rules_3 = ValueList({"Random": 0, "UserSelectedParam": 1, "UserSelectedPt": 2}, selected="UserSelectedParam")
genes_3 = GenePool(Decimals=2, Maximum=10, Minimum=-10, Value=[0.87, 7.64, 4.296032532])
number_slider_3 = Slider(0.715, range=0..1)
selectforce_5 = SelectForce(Model=transform_2, Identifier=Slider(1, range=0..1))  # -> ForceObject, ForceName, AnchorNodeObject, ForceDirection, ForceMagnitude
selectforce_6 = SelectForce(Model=transform_2, Identifier=Slider(0.84, range=0..1))  # -> ForceObject, ForceName, AnchorNodeObject, ForceDirection, ForceMagnitude
nodeprule_3 = ConstructNodePlacementRule(NodePlacementRuleID=node_placement_rules_3, MinDistanceToModel=Slider(0.25, range=0..1))
forceirule_3 = ConstructForceIndeterminaciesRule(ForceIndeterminaciesRuleID=force_indeterminacies_rules_3)
candidate_configuration_3 = ValueList({"Inbetween": 0, "Peripheral": 1, "Central": 2}, selected="Inbetween")
entropy_rate_policies_3 = ValueList({"Converge": -1, "Stagnate": 0, "Diverge": 1}, selected="Stagnate")
constructforceset_3 = ConstructForceSet(
    EntropyRate=entropy_rate_policies_3,
    Configuration=candidate_configuration_3,
    ModelWithDomain=transform_2,
    Forces=[selectforce_5.ForceObject, selectforce_6.ForceObject])  # -> IsValid, ForceSet, EntropyRateDomain, ConstructabilityDomain
policy_3 = ConstructTransformationPolicy(
    EntropyRate=entropy_rate_policies_3,
    ForceSelectionRuleForcesSet=constructforceset_3.ForceSet,
    NodePlacementRulePoint=nodeprule_3,
    ForceIndeterminaciesRuleAxialForces=forceirule_3)
transform_3 = ApplyTransformationPolicy(Execute=Toggle(True), Iterations=Slider(1, range=1..10), Model=transform_2, Policy=policy_3)

force_indeterminacies_rules_4 = ValueList({"Random": 0, "UserDefinedMagnitude": 1}, selected="UserDefinedMagnitude")
node_placement_rules_4 = ValueList({"Random": 0, "UserSelectedParam": 1, "UserSelectedPt": 2}, selected="UserSelectedParam")
genes_4 = GenePool(Decimals=2, Maximum=10, Minimum=-10, Value=[4.55, -0.1641388844, 4.296032532])
number_slider_4 = Slider(0.5, range=0..1)
selectforce_7 = SelectForce(Model=transform_3, Identifier=Slider(0.812, range=0..1))  # -> ForceObject, ForceName, AnchorNodeObject, ForceDirection, ForceMagnitude
selectforce_8 = SelectForce(Model=transform_3, Identifier=Slider(1, range=0..1))  # -> ForceObject, ForceName, AnchorNodeObject, ForceDirection, ForceMagnitude
nodeprule_4 = ConstructNodePlacementRule(NodePlacementRuleID=node_placement_rules_4, MinDistanceToModel=Slider(0.25, range=0..1))
forceirule_4 = ConstructForceIndeterminaciesRule(ForceIndeterminaciesRuleID=force_indeterminacies_rules_4)
candidate_configuration_4 = ValueList({"Inbetween": 0, "Peripheral": 1, "Central": 2}, selected="Inbetween")
entropy_rate_policies_4 = ValueList({"Converge": -1, "Stagnate": 0, "Diverge": 1}, selected="Converge")
constructforceset_4 = ConstructForceSet(
    EntropyRate=entropy_rate_policies_4,
    Configuration=candidate_configuration_4,
    ModelWithDomain=transform_3,
    Forces=[selectforce_7.ForceObject, selectforce_8.ForceObject])  # -> IsValid, ForceSet, EntropyRateDomain, ConstructabilityDomain
policy_4 = ConstructTransformationPolicy(
    EntropyRate=entropy_rate_policies_4,
    ForceSelectionRuleForcesSet=constructforceset_4.ForceSet,
    NodePlacementRulePoint=nodeprule_4,
    ForceIndeterminaciesRuleAxialForces=forceirule_4)
transform_4 = ApplyTransformationPolicy(Execute=Toggle(True), Iterations=Slider(1, range=1..10), Model=transform_3, Policy=policy_4)

force_indeterminacies_rules_5 = ValueList({"Random": 0, "UserDefinedMagnitude": 1}, selected="UserDefinedMagnitude")
node_placement_rules_5 = ValueList({"Random": 0, "UserSelectedParam": 1, "UserSelectedPt": 2}, selected="UserSelectedPt")
genes_5 = GenePool(Decimals=2, Maximum=10, Minimum=-10, Value=[1.76, -4.18, 4.296032532])
pt_17 = Point(<point referenced from the Rhino model>)
selectforce_9 = SelectForce(Model=transform_4, Identifier=Slider(1, range=0..1))  # -> ForceObject, ForceName, AnchorNodeObject, ForceDirection, ForceMagnitude
selectforce_10 = SelectForce(Model=transform_4, Identifier=Slider(0.202, range=0..1))  # -> ForceObject, ForceName, AnchorNodeObject, ForceDirection, ForceMagnitude
nodeprule_5 = ConstructNodePlacementRule(NodePlacementRuleID=node_placement_rules_5, MinDistanceToModel=Slider(0.25, range=0..1))
forceirule_5 = ConstructForceIndeterminaciesRule(ForceIndeterminaciesRuleID=force_indeterminacies_rules_5)
candidate_configuration_5 = ValueList({"Inbetween": 0, "Peripheral": 1, "Central": 2}, selected="Inbetween")
entropy_rate_policies_5 = ValueList({"Converge": -1, "Stagnate": 0, "Diverge": 1}, selected="Diverge")
constructforceset_5 = ConstructForceSet(
    EntropyRate=entropy_rate_policies_5,
    Configuration=candidate_configuration_5,
    ModelWithDomain=transform_4,
    Forces=[selectforce_9.ForceObject, selectforce_10.ForceObject])  # -> IsValid, ForceSet, EntropyRateDomain, ConstructabilityDomain
policy_5 = ConstructTransformationPolicy(
    EntropyRate=entropy_rate_policies_5,
    ForceSelectionRuleForcesSet=constructforceset_5.ForceSet,
    NodePlacementRulePoint=nodeprule_5,
    ForceIndeterminaciesRuleAxialForces=forceirule_5)
transform_5 = ApplyTransformationPolicy(Execute=Toggle(True), Iterations=Slider(1, range=1..10), Model=transform_4, Policy=policy_5)

force_indeterminacies_rules_6 = ValueList({"Random": 0, "UserDefinedMagnitude": 1}, selected="UserDefinedMagnitude")
node_placement_rules_6 = ValueList({"Random": 0, "UserSelectedParam": 1, "UserSelectedPt": 2}, selected="UserSelectedParam")
genes_6 = GenePool(Decimals=2, Maximum=10, Minimum=-10, Value=[5.39, -0.1641388844, 4.296032532])
number_slider_5 = Slider(0.5, range=0..1)
selectforce_11 = SelectForce(Model=transform_5, Identifier=Slider(1, range=0..1))  # -> ForceObject, ForceName, AnchorNodeObject, ForceDirection, ForceMagnitude
selectforce_12 = SelectForce(Model=transform_5, Identifier=Slider(0.16, range=0..1))  # -> ForceObject, ForceName, AnchorNodeObject, ForceDirection, ForceMagnitude
nodeprule_6 = ConstructNodePlacementRule(NodePlacementRuleID=node_placement_rules_6, MinDistanceToModel=Slider(0.25, range=0..1))
forceirule_6 = ConstructForceIndeterminaciesRule(ForceIndeterminaciesRuleID=force_indeterminacies_rules_6)
candidate_configuration_6 = ValueList({"Inbetween": 0, "Peripheral": 1, "Central": 2}, selected="Inbetween")
entropy_rate_policies_6 = ValueList({"Converge": -1, "Stagnate": 0, "Diverge": 1}, selected="Converge")
constructforceset_6 = ConstructForceSet(
    EntropyRate=entropy_rate_policies_6,
    Configuration=candidate_configuration_6,
    ModelWithDomain=transform_5,
    Forces=[selectforce_11.ForceObject, selectforce_12.ForceObject])  # -> IsValid, ForceSet, EntropyRateDomain, ConstructabilityDomain
policy_6 = ConstructTransformationPolicy(
    EntropyRate=entropy_rate_policies_6,
    ForceSelectionRuleForcesSet=constructforceset_6.ForceSet,
    NodePlacementRulePoint=nodeprule_6,
    ForceIndeterminaciesRuleAxialForces=forceirule_6)
transform_6 = ApplyTransformationPolicy(Execute=Toggle(True), Iterations=Slider(1, range=1..10), Model=transform_5, Policy=policy_6)

force_indeterminacies_rules_7 = ValueList({"Random": 0, "UserDefinedMagnitude": 1}, selected="UserDefinedMagnitude")
node_placement_rules_7 = ValueList({"Random": 0, "UserSelectedParam": 1, "UserSelectedPt": 2}, selected="UserSelectedParam")
genes_7 = GenePool(Decimals=2, Maximum=10, Minimum=-10, Value=[4.34, 1.49, 4.296032532])
number_slider_6 = Slider(0.68, range=0..1)
selectforce_13 = SelectForce(Model=transform_6, Identifier=Slider(0.915, range=0..1))  # -> ForceObject, ForceName, AnchorNodeObject, ForceDirection, ForceMagnitude
selectforce_14 = SelectForce(Model=transform_6, Identifier=Slider(0.985, range=0..1))  # -> ForceObject, ForceName, AnchorNodeObject, ForceDirection, ForceMagnitude
nodeprule_7 = ConstructNodePlacementRule(NodePlacementRuleID=node_placement_rules_7, MinDistanceToModel=Slider(0.25, range=0..1))
forceirule_7 = ConstructForceIndeterminaciesRule(ForceIndeterminaciesRuleID=force_indeterminacies_rules_7)
candidate_configuration_7 = ValueList({"Inbetween": 0, "Peripheral": 1, "Central": 2}, selected="Inbetween")
entropy_rate_policies_7 = ValueList({"Converge": -1, "Stagnate": 0, "Diverge": 1}, selected="Stagnate")
constructforceset_7 = ConstructForceSet(
    EntropyRate=entropy_rate_policies_7,
    Configuration=candidate_configuration_7,
    ModelWithDomain=transform_6,
    Forces=[selectforce_13.ForceObject, selectforce_14.ForceObject])  # -> IsValid, ForceSet, EntropyRateDomain, ConstructabilityDomain
policy_7 = ConstructTransformationPolicy(
    EntropyRate=entropy_rate_policies_7,
    ForceSelectionRuleForcesSet=constructforceset_7.ForceSet,
    NodePlacementRulePoint=nodeprule_7,
    ForceIndeterminaciesRuleAxialForces=forceirule_7)
transform_7 = ApplyTransformationPolicy(Execute=Toggle(True), Iterations=Slider(1, range=1..10), Model=transform_6, Policy=policy_7)

force_indeterminacies_rules_8 = ValueList({"Random": 0, "UserDefinedMagnitude": 1}, selected="UserDefinedMagnitude")
node_placement_rules_8 = ValueList({"Random": 0, "UserSelectedParam": 1, "UserSelectedPt": 2}, selected="UserSelectedParam")
genes_8 = GenePool(Decimals=2, Maximum=10, Minimum=-10, Value=[10, -0.55, 4.296032532])
number_slider_7 = Slider(0.802, range=0..1)
selectforce_15 = SelectForce(Model=transform_7, Identifier=Slider(0.915, range=0..1))  # -> ForceObject, ForceName, AnchorNodeObject, ForceDirection, ForceMagnitude
selectforce_16 = SelectForce(Model=transform_7, Identifier=Slider(0.687, range=0..1))  # -> ForceObject, ForceName, AnchorNodeObject, ForceDirection, ForceMagnitude
nodeprule_8 = ConstructNodePlacementRule(NodePlacementRuleID=node_placement_rules_8, MinDistanceToModel=Slider(0.25, range=0..1))
forceirule_8 = ConstructForceIndeterminaciesRule(ForceIndeterminaciesRuleID=force_indeterminacies_rules_8)
candidate_configuration_8 = ValueList({"Inbetween": 0, "Peripheral": 1, "Central": 2}, selected="Inbetween")
entropy_rate_policies_8 = ValueList({"Converge": -1, "Stagnate": 0, "Diverge": 1}, selected="Converge")
constructforceset_8 = ConstructForceSet(
    EntropyRate=entropy_rate_policies_8,
    Configuration=candidate_configuration_8,
    ModelWithDomain=transform_7,
    Forces=[selectforce_15.ForceObject, selectforce_16.ForceObject])  # -> IsValid, ForceSet, EntropyRateDomain, ConstructabilityDomain
policy_8 = ConstructTransformationPolicy(
    EntropyRate=entropy_rate_policies_8,
    ForceSelectionRuleForcesSet=constructforceset_8.ForceSet,
    NodePlacementRulePoint=nodeprule_8,
    ForceIndeterminaciesRuleAxialForces=forceirule_8)
transform_8 = ApplyTransformationPolicy(Execute=Toggle(True), Iterations=Slider(1, range=1..10), Model=transform_7, Policy=policy_8)

force_indeterminacies_rules_9 = ValueList({"Random": 0, "UserDefinedMagnitude": 1}, selected="UserDefinedMagnitude")
node_placement_rules_9 = ValueList({"Random": 0, "UserSelectedParam": 1, "UserSelectedPt": 2}, selected="UserSelectedParam")
genes_9 = GenePool(Decimals=2, Maximum=10, Minimum=-10, Value=[-5.44, 0.22, 4.296032532])
number_slider_8 = Slider(0.921, range=0..1)
selectforce_17 = SelectForce(Model=transform_8, Identifier=Slider(0.915, range=0..1))  # -> ForceObject, ForceName, AnchorNodeObject, ForceDirection, ForceMagnitude
selectforce_18 = SelectForce(Model=transform_8, Identifier=Slider(0.96, range=0..1))  # -> ForceObject, ForceName, AnchorNodeObject, ForceDirection, ForceMagnitude
nodeprule_9 = ConstructNodePlacementRule(NodePlacementRuleID=node_placement_rules_9, MinDistanceToModel=Slider(0.25, range=0..1))
forceirule_9 = ConstructForceIndeterminaciesRule(ForceIndeterminaciesRuleID=force_indeterminacies_rules_9)
candidate_configuration_9 = ValueList({"Inbetween": 0, "Peripheral": 1, "Central": 2}, selected="Inbetween")
entropy_rate_policies_9 = ValueList({"Converge": -1, "Stagnate": 0, "Diverge": 1}, selected="Converge")
constructforceset_9 = ConstructForceSet(
    EntropyRate=entropy_rate_policies_9,
    Configuration=candidate_configuration_9,
    ModelWithDomain=transform_8,
    Forces=[selectforce_17.ForceObject, selectforce_18.ForceObject])  # -> IsValid, ForceSet, EntropyRateDomain, ConstructabilityDomain
policy_9 = ConstructTransformationPolicy(
    EntropyRate=entropy_rate_policies_9,
    ForceSelectionRuleForcesSet=constructforceset_9.ForceSet,
    NodePlacementRulePoint=nodeprule_9,
    ForceIndeterminaciesRuleAxialForces=forceirule_9)
transform_9 = ApplyTransformationPolicy(Execute=Toggle(True), Iterations=Slider(1, range=1..10), Model=transform_8, Policy=policy_9)

force_indeterminacies_rules_10 = ValueList({"Random": 0, "UserDefinedMagnitude": 1}, selected="UserDefinedMagnitude")
node_placement_rules_10 = ValueList({"Random": 0, "UserSelectedParam": 1, "UserSelectedPt": 2}, selected="UserSelectedParam")
genes_10 = GenePool(Decimals=2, Maximum=10, Minimum=-10, Value=[-5.68, 0.07, 4.296032532])
number_slider_9 = Slider(0.696, range=0..1)
selectforce_19 = SelectForce(Model=transform_9, Identifier=Slider(0.995, range=0..1))  # -> ForceObject, ForceName, AnchorNodeObject, ForceDirection, ForceMagnitude
selectforce_20 = SelectForce(Model=transform_9, Identifier=Slider(0.267, range=0..1))  # -> ForceObject, ForceName, AnchorNodeObject, ForceDirection, ForceMagnitude
nodeprule_10 = ConstructNodePlacementRule(NodePlacementRuleID=node_placement_rules_10, MinDistanceToModel=Slider(0.25, range=0..1))
forceirule_10 = ConstructForceIndeterminaciesRule(ForceIndeterminaciesRuleID=force_indeterminacies_rules_10)
candidate_configuration_10 = ValueList({"Inbetween": 0, "Peripheral": 1, "Central": 2}, selected="Inbetween")
entropy_rate_policies_10 = ValueList({"Converge": -1, "Stagnate": 0, "Diverge": 1}, selected="Stagnate")
constructforceset_10 = ConstructForceSet(
    EntropyRate=entropy_rate_policies_10,
    Configuration=candidate_configuration_10,
    ModelWithDomain=transform_9,
    Forces=[selectforce_19.ForceObject, selectforce_20.ForceObject])  # -> IsValid, ForceSet, EntropyRateDomain, ConstructabilityDomain
policy_10 = ConstructTransformationPolicy(
    EntropyRate=entropy_rate_policies_10,
    ForceSelectionRuleForcesSet=constructforceset_10.ForceSet,
    NodePlacementRulePoint=nodeprule_10,
    ForceIndeterminaciesRuleAxialForces=forceirule_10)
transform_10 = ApplyTransformationPolicy(Execute=Toggle(True), Iterations=Slider(1, range=1..10), Model=transform_9, Policy=policy_10)

force_indeterminacies_rules_11 = ValueList({"Random": 0, "UserDefinedMagnitude": 1}, selected="UserDefinedMagnitude")
node_placement_rules_11 = ValueList({"Random": 0, "UserSelectedParam": 1, "UserSelectedPt": 2}, selected="UserSelectedParam")
genes_11 = GenePool(Decimals=2, Maximum=10, Minimum=-10, Value=[3.58, 0.22, 4.296032532])
number_slider_10 = Slider(0.434, range=0..1)
selectforce_21 = SelectForce(Model=transform_10, Identifier=Slider(1, range=0..1))  # -> ForceObject, ForceName, AnchorNodeObject, ForceDirection, ForceMagnitude
selectforce_22 = SelectForce(Model=transform_10, Identifier=Slider(0.605, range=0..1))  # -> ForceObject, ForceName, AnchorNodeObject, ForceDirection, ForceMagnitude
nodeprule_11 = ConstructNodePlacementRule(NodePlacementRuleID=node_placement_rules_11, MinDistanceToModel=Slider(0.25, range=0..1))
forceirule_11 = ConstructForceIndeterminaciesRule(ForceIndeterminaciesRuleID=force_indeterminacies_rules_11)
candidate_configuration_11 = ValueList({"Inbetween": 0, "Peripheral": 1, "Central": 2}, selected="Inbetween")
entropy_rate_policies_11 = ValueList({"Converge": -1, "Stagnate": 0, "Diverge": 1}, selected="Stagnate")
constructforceset_11 = ConstructForceSet(
    EntropyRate=entropy_rate_policies_11,
    Configuration=candidate_configuration_11,
    ModelWithDomain=transform_10,
    Forces=[selectforce_21.ForceObject, selectforce_22.ForceObject])  # -> IsValid, ForceSet, EntropyRateDomain, ConstructabilityDomain
policy_11 = ConstructTransformationPolicy(
    EntropyRate=entropy_rate_policies_11,
    ForceSelectionRuleForcesSet=constructforceset_11.ForceSet,
    NodePlacementRulePoint=nodeprule_11,
    ForceIndeterminaciesRuleAxialForces=forceirule_11)
transform_11 = ApplyTransformationPolicy(Execute=Toggle(True), Iterations=Slider(1, range=1..10), Model=transform_10, Policy=policy_11)

force_indeterminacies_rules_12 = ValueList({"Random": 0, "UserDefinedMagnitude": 1}, selected="UserDefinedMagnitude")
node_placement_rules_12 = ValueList({"Random": 0, "UserSelectedParam": 1, "UserSelectedPt": 2}, selected="UserSelectedParam")
genes_12 = GenePool(Decimals=2, Maximum=10, Minimum=-10, Value=[0.72, 0.22, 4.296032532])
number_slider_11 = Slider(0.367, range=0..1)
selectforce_23 = SelectForce(Model=transform_11, Identifier=Slider(1, range=0..1))  # -> ForceObject, ForceName, AnchorNodeObject, ForceDirection, ForceMagnitude
selectforce_24 = SelectForce(Model=transform_11, Identifier=Slider(0.61, range=0..1))  # -> ForceObject, ForceName, AnchorNodeObject, ForceDirection, ForceMagnitude
nodeprule_12 = ConstructNodePlacementRule(NodePlacementRuleID=node_placement_rules_12, MinDistanceToModel=Slider(0.25, range=0..1))
forceirule_12 = ConstructForceIndeterminaciesRule(ForceIndeterminaciesRuleID=force_indeterminacies_rules_12)
candidate_configuration_12 = ValueList({"Inbetween": 0, "Peripheral": 1, "Central": 2}, selected="Inbetween")
entropy_rate_policies_12 = ValueList({"Converge": -1, "Stagnate": 0, "Diverge": 1}, selected="Converge")
constructforceset_12 = ConstructForceSet(
    EntropyRate=entropy_rate_policies_12,
    Configuration=candidate_configuration_12,
    ModelWithDomain=transform_11,
    Forces=[selectforce_23.ForceObject, selectforce_24.ForceObject])  # -> IsValid, ForceSet, EntropyRateDomain, ConstructabilityDomain
policy_12 = ConstructTransformationPolicy(
    EntropyRate=entropy_rate_policies_12,
    ForceSelectionRuleForcesSet=constructforceset_12.ForceSet,
    NodePlacementRulePoint=nodeprule_12,
    ForceIndeterminaciesRuleAxialForces=forceirule_12)
transform_12 = ApplyTransformationPolicy(Execute=Toggle(True), Iterations=Slider(1, range=1..10), Model=transform_11, Policy=policy_12)

force_indeterminacies_rules_13 = ValueList({"Random": 0, "UserDefinedMagnitude": 1}, selected="UserDefinedMagnitude")
node_placement_rules_13 = ValueList({"Random": 0, "UserSelectedParam": 1, "UserSelectedPt": 2}, selected="UserSelectedParam")
genes_13 = GenePool(Decimals=2, Maximum=10, Minimum=-10, Value=[-4.42, 0.22, 4.296032532])
number_slider_12 = Slider(0.287, range=0..1)
selectforce_25 = SelectForce(Model=transform_12, Identifier=Slider(0.986, range=0..1))  # -> ForceObject, ForceName, AnchorNodeObject, ForceDirection, ForceMagnitude
selectforce_26 = SelectForce(Model=transform_12, Identifier=Slider(0.489, range=0..1))  # -> ForceObject, ForceName, AnchorNodeObject, ForceDirection, ForceMagnitude
nodeprule_13 = ConstructNodePlacementRule(NodePlacementRuleID=node_placement_rules_13, MinDistanceToModel=Slider(0.25, range=0..1))
forceirule_13 = ConstructForceIndeterminaciesRule(ForceIndeterminaciesRuleID=force_indeterminacies_rules_13)
candidate_configuration_13 = ValueList({"Inbetween": 0, "Peripheral": 1, "Central": 2}, selected="Inbetween")
entropy_rate_policies_13 = ValueList({"Converge": -1, "Stagnate": 0, "Diverge": 1}, selected="Converge")
constructforceset_13 = ConstructForceSet(
    EntropyRate=entropy_rate_policies_13,
    Configuration=candidate_configuration_13,
    ModelWithDomain=transform_12,
    Forces=[selectforce_25.ForceObject, selectforce_26.ForceObject])  # -> IsValid, ForceSet, EntropyRateDomain, ConstructabilityDomain
policy_13 = ConstructTransformationPolicy(
    EntropyRate=entropy_rate_policies_13,
    ForceSelectionRuleForcesSet=constructforceset_13.ForceSet,
    NodePlacementRulePoint=nodeprule_13,
    ForceIndeterminaciesRuleAxialForces=forceirule_13)
transform_13 = ApplyTransformationPolicy(Execute=Toggle(True), Iterations=Slider(1, range=1..10), Model=transform_12, Policy=policy_13)

force_s_selection_rule = ValueList({"Random": 0, "ProximityToUserSelectedPoint": 1, "MinMagnitude": 2, "MaxMagnitude": 3, "Oldest": 4, "Newest": 5, "Closest": 6, "Furthest": 7, "ClosestToDomainCentroid": 8, "FurthestToDomainCentroid": 9, "ClosestToPtCloud": 10, "FurthestToPtCloud": 11}, selected="Newest")
force_indeterminacies_rule = ValueList({"Random": 0, "UserDefinedMagnitude": 1}, selected="UserDefinedMagnitude")
node_placement_rule = ValueList({"Random": 0, "UserSelectedParam": 1, "UserSelectedPt": 2}, selected="UserSelectedParam")
topological_configuration = ValueList({"Inbetween": 0, "Peripheral": 1, "Central": 2}, selected="Inbetween")
genes_14 = GenePool(Decimals=2, Maximum=10, Minimum=-10, Value=[-4.42, 0.22, 4.296032532])
type_of_force_set = ValueList({"Monomial": 0, "Binomial": 1}, selected="Binomial")
number_slider_13 = Slider(0.25, range=0..1)
forcesrule = ConstructForceSelectionRule(
    ForceSelectionRuleID=force_s_selection_rule,
    TypeOfForceSet=type_of_force_set,
    TopologicalConfiguration=topological_configuration,
    FlipForcesOrder=Toggle(False))
nodeprule_14 = ConstructNodePlacementRule(NodePlacementRuleID=node_placement_rule, MinDistanceToModel=Slider(0.25, range=0..1))
forceirule_14 = ConstructForceIndeterminaciesRule(ForceIndeterminaciesRuleID=force_indeterminacies_rule)
entropy_rate = ValueList({"Convergence": -1, "Stagnation": 0, "Divergence": 1}, selected="Stagnation")
policy_14 = ConstructTransformationPolicy(
    EntropyRate=entropy_rate,
    ForceSelectionRuleForcesSet=forcesrule,
    NodePlacementRulePoint=nodeprule_14,
    ForceIndeterminaciesRuleAxialForces=forceirule_14)
transform_14 = ApplyTransformationPolicy(Execute=Toggle(True), Iterations=Slider(1, range=1..10), Model=transform_13, Policy=policy_14)

pt_18 = Point(<point referenced from the Rhino model>)
yz = YZPlane(Origin=pt_18)
modelgeometry = ModelGeometry(Model=transform_14, MirrorPlane=yz, NodalRadius=Slider(0.25, range=0..3), ForcesScale=Slider(1, range=0..3))  # -> forces_ext, forces_int, bars_compression, bars_tension, nodes
