# Grasshopper definition symmetric_pylon_transformation[iga].gh (Grasshopper 1.0.7)
# plug-ins: Libra

pt = Point(<point referenced from the Rhino model>)
pt_2 = Point(<point referenced from the Rhino model>)
pt_3 = Point(<point referenced from the Rhino model>)
pt_4 = Point(<point referenced from the Rhino model>)
pt_5 = Point(<point referenced from the Rhino model>)
pt_6 = Point(<point referenced from the Rhino model>)
pt_7 = Point(<point referenced from the Rhino model>)
pt_8 = Point(<point referenced from the Rhino model>)
pt_9 = Point(<point referenced from the Rhino model>)
pt_10 = Point(<point referenced from the Rhino model>)
pt_11 = Point(<point referenced from the Rhino model>)
pt_12 = Point(<point referenced from the Rhino model>)
pt_13 = Point(<point referenced from the Rhino model>)
pt_14 = Point(<point referenced from the Rhino model>)
pt_15 = Point(<point referenced from the Rhino model>)
pt_16 = Point(<point referenced from the Rhino model>)
vec2pt = Vector2Pt(PointA=pt, PointB=pt_2, Unitize=False)  # -> Vector, Length
vec2pt_2 = Vector2Pt(PointA=pt_3, PointB=pt_4, Unitize=False)  # -> Vector, Length
vec2pt_3 = Vector2Pt(PointA=pt_5, PointB=pt_6, Unitize=False)  # -> Vector, Length
vec2pt_4 = Vector2Pt(PointA=pt_7, PointB=pt_8, Unitize=False)  # -> Vector, Length
vec2pt_5 = Vector2Pt(PointA=pt_9, PointB=pt_10, Unitize=False)  # -> Vector, Length
vec2pt_6 = Vector2Pt(PointA=pt_11, PointB=pt_12, Unitize=False)  # -> Vector, Length
vec2pt_7 = Vector2Pt(PointA=pt_13, PointB=pt_14, Unitize=False)  # -> Vector, Length
vec2pt_8 = Vector2Pt(PointA=pt_15, PointB=pt_16, Unitize=False)  # -> Vector, Length
crv = Curve(<curve referenced from the Rhino model>)
builddomain = BuildDomain(RegionsIn=crv)
merge = Merge(Data1=pt_2, Data2=pt_4, Data3=pt_6, Data4=pt_8, Data5=pt_10, Data6=pt_12, Data7=pt_14, Data8=pt_16)
merge_2 = Merge(
    Data1=vec2pt.Vector,
    Data2=vec2pt_2.Vector,
    Data3=vec2pt_3.Vector,
    Data4=vec2pt_4.Vector,
    Data5=vec2pt_5.Vector,
    Data6=vec2pt_6.Vector,
    Data7=vec2pt_7.Vector,
    Data8=vec2pt_8.Vector)
buildmodel = BuildModelWithVectors(AnchorNode=merge, ForceVector=merge_2, DesignDomain=builddomain)
force_s_selection_rule = ValueList({"Random": 0, "ProximityToUserSelectedPoint": 1, "MinMagnitude": 2, "MaxMagnitude": 3, "Oldest": 4, "Newest": 5, "Closest": 6, "Furthest": 7, "ClosestToDomainCentroid": 8, "FurthestToDomainCentroid": 9, "ClosestToPtCloud": 10, "FurthestToPtCloud": 11}, selected="MinMagnitude")
force_indeterminacies_rules = ValueList({"Random": 0, "UserDefinedMagnitude": 1}, selected="UserDefinedMagnitude")
genes = GenePool(
    Decimals=0,
    Maximum=1,
    Minimum=0,
    Value=[0.2035491859, 0.7597147689, 0.5316316156, 0.1727702486, 0.506500233, 0.894912424, 0.7227094536])
node_placement_rules = ValueList({"Random": 0, "UserSelectedParam": 1, "UserSelectedPt": 2}, selected="UserSelectedParam")
configuration_of_force_set = ValueList({"Inbetween": 0, "Peripheral": 1, "Central": 2}, selected="Inbetween")
genes_2 = GenePool(
    Decimals=0,
    Maximum=11,
    Minimum=2,
    Value=[2.905823457, 2.76854977, 10.14361698, 5.535846891, 5.882448503, 4.506571919, 2.080486635])
genes_3 = GenePool(
    Decimals=4,
    Maximum=1,
    Minimum=0,
    Value=[0.9190616745, 0.1357121156, 0.3318654069, 0.3288856535, 0.2965923571, 0.3898419376, 0.6328566343])
genes_4 = GenePool(
    Decimals=2,
    Maximum=10,
    Minimum=-10,
    Value=[7.704834669, 9.150243789, -4.55629594, -9.447473244, 9.745150261, 3.593929656, -0.8833215611, -5.935377914, 0.5215967879, -0.1401670086, -6.598333363, 3.138487632, -3.89220618, 3.826963446, 8.15192724, -8.495146615, 4.478076843, 5.307981171, 6.79866082, 1.614896731, 9.094509268])
type_of_force_set = ValueList({"Monomial": 0, "Binomial": 1}, selected="Binomial")
toggle = BooleanToggle(False)
python = GhPythonScript(x=genes)  # -> out, bool; inputs x: list of Int32
# ---------- python: Python ----------
bool = []
for val in x:
    if val == 0:
        bool.append(False)
    else:
        bool.append(True)
print bool
# ---------- end python ----------
forcesrule = BuildForceSelectionRule(
    ForceSelectionRuleID=genes_2,
    TypeOfForceSet=type_of_force_set,
    Configuration=configuration_of_force_set,
    FlipForcesOrder=python.bool)
nodeprule = BuildNodePlacementRule(NodePlacementRuleID=node_placement_rules, MinDistanceToModel=Slider(0.25, range=0..1), TParam=genes_3)
forceirule = BuildForceIndeterminaciesRule(ForceIndeterminaciesRuleID=force_indeterminacies_rules, Forces=genes_4)
entropy_rate = ValueList({"Convergence": -1, "Stagnation": 0, "Divergence": 1}, selected="Convergence")
policy = BuildTransformationPolicy(
    EntropyRate=entropy_rate,
    ForceSelectionRuleForcesSet=forcesrule,
    NodePlacementRulePoint=nodeprule,
    ForceIndeterminaciesRuleAxialForces=forceirule)
panel = Panel(policy)
transform = ApplyTransformationPolicy(Execute=Toggle(True), Iterations=Slider(7, range=1..30), Model=buildmodel, Policy=policy)
modelhistory = ModelHistory(Model=transform, Iteration=-1)  # -> ForceSelectionRule, NodePlacementRule, ForceIndeterminaciesRule, EntropyRate, ForceSet, IntroducedPoint, ForceMagnitudes, ForceVectors
panel_2 = Panel(modelhistory.ForceSelectionRule)
panel_3 = Panel(modelhistory.NodePlacementRule)
modelmetrics = ModelMetricsText(Model=transform)  # -> AllMetrics, StaticAction, NumberOfBars, NumberOfNodes, DegreeOfNonPlanarity, TemporaryForces, MinBarLength, MaxBarLength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
panel_4 = Panel(modelmetrics.AllMetrics)
static_action = Panel(modelmetrics.StaticAction)
intersections = Panel(modelmetrics.DegreeOfNonPlanarity)
area = Panel(modelmetrics.AreaVolume)
dse_iga = DesignSpaceExploration(
    Genome=[genes_3, genes_4, genes_2, genes],
    Model=transform,
    Objectives=[modelmetrics.NumberOfBars, modelmetrics.DegreeOfNonPlanarity])
bars = Panel(modelmetrics.NumberOfBars)
temporary_forces = Panel(modelmetrics.TemporaryForces)
dsestorage = DesignSpaceExplorationStorage(dse_iga)
dsereader = DesignSpaceExplorationReader(Solutions=dsestorage, Branch=0, Generation=Slider(2, range=0..2), Design=Slider(43, range=0..47))
