# Grasshopper definition simple_pylon_transformation[completed].gh (Grasshopper 1.0.7)
# plug-ins: Libra

# ----
# multi-used implicitly defined rule
force_s_selection_rule = ValueList({"Random": 0, "ProximityToUserSelectedPoint": 1, "MinMagnitude": 2, "MaxMagnitude": 3, "Oldest": 4, "Newest": 5, "Oldest_Newest_Bi": 6, "Closest": 7, "Furthest": 8, "ClosestToDomainCentroid": 9, "FurthestToDomainCentroid": 10, "ClosestToPtCloud": 11, "FurthestToPtCloud": 12}, selected="Newest")
topological_configuration = ValueList({"Inbetween": 0, "Peripheral": 1}, selected="Inbetween")
type_of_force_set = ValueList({"Monomial": 0, "Binomial": 1}, selected="Binomial")
forcesrule = ConstructForceSelectionRule(
    ForceSelectionRuleID=force_s_selection_rule,
    TypeOfForceSet=type_of_force_set,
    TopologicalConfiguration=topological_configuration,
    FlipForcesOrder=Toggle(False))

# ----
# construct domain
crv = Curve(<curve referenced from the Rhino model>)
constructdomain = ConstructDomain(RegionsIn=crv)

# ----
# construct model
pt = Point(<point referenced from the Rhino model>)
pt_2 = Point(<point referenced from the Rhino model>)
pt_3 = Point(<point referenced from the Rhino model>)
pt_4 = Point(<point referenced from the Rhino model>)
pt_5 = Point(<point referenced from the Rhino model>)
pt_6 = Point(<point referenced from the Rhino model>)
pt_7 = Point(<point referenced from the Rhino model>)
pt_8 = Point(<point referenced from the Rhino model>)
pt_9 = Point(<point referenced from the Rhino model>)
pt_10 = Point(<point referenced from the Rhino model>)
vec2pt = Vector2Pt(PointA=pt, PointB=pt_2, Unitize=False)  # -> Vector, Length
vec2pt_2 = Vector2Pt(PointA=pt_3, PointB=pt_4, Unitize=False)  # -> Vector, Length
vec2pt_3 = Vector2Pt(PointA=pt_5, PointB=pt_6, Unitize=False)  # -> Vector, Length
vec2pt_4 = Vector2Pt(PointA=pt_7, PointB=pt_8, Unitize=False)  # -> Vector, Length
vec2pt_5 = Vector2Pt(PointA=pt_9, PointB=pt_10, Unitize=False)  # -> Vector, Length
merge = Merge(Data1=pt_2, Data2=pt_4, Data3=pt_6, Data4=pt_8, Data5=pt_10)
merge_2 = Merge(Data1=vec2pt.Vector, Data2=vec2pt_2.Vector, Data3=vec2pt_3.Vector, Data4=vec2pt_4.Vector, Data5=vec2pt_5.Vector)
constructmodel = ConstructModel(AnchorNode=merge, ForceVector=merge_2, DesignDomain=constructdomain)

# ---- group: Transformation Policy Parameters
force_s_selection_rule_2 = ValueList({"Random": 0, "ProximityToUserSelectedPoint": 1, "MinMagnitude": 2, "MaxMagnitude": 3, "Oldest": 4, "Newest": 5, "Oldest_Newest_Bi": 6, "Closest": 7, "Furthest": 8, "ClosestToDomainCentroid": 9, "FurthestToDomainCentroid": 10, "ClosestToPtCloud": 11, "FurthestToPtCloud": 12}, selected="Oldest")
force_indeterminacies_rule = ValueList({"Random": 0, "UserDefinedMagnitude": 1}, selected="UserDefinedMagnitude")
node_placement_rule = ValueList({"Random": 0, "UserSelectedParam": 1, "UserSelectedPt": 2, "ClosestPossible": 3, "FurthestPossible": 4, "NoNode": 5}, selected="UserSelectedParam")
topological_configuration_2 = ValueList({"Inbetween": 0, "Peripheral": 1}, selected="Inbetween")
genes = GenePool(Decimals=2, Maximum=10, Minimum=-10, Value=[-0.84, 3.76])
type_of_force_set_2 = ValueList({"Monomial": 0, "Binomial": 1}, selected="Binomial")
forcesrule_2 = ConstructForceSelectionRule(
    ForceSelectionRuleID=force_s_selection_rule_2,
    TypeOfForceSet=type_of_force_set_2,
    TopologicalConfiguration=topological_configuration_2,
    FlipForcesOrder=Toggle(False))
nodeprule = ConstructNodePlacementRule(NodePlacementRuleID=node_placement_rule, MinDistanceToModel=Slider(0.25, range=0..1), TParam=Slider(0.414, range=0..1))
forceirule = ConstructForceIndeterminaciesRule(ForceIndeterminaciesRuleID=force_indeterminacies_rule, Forces=genes)
entropy_rate = ValueList({"Convergence": -1, "Stagnation": 0, "Divergence": 1}, selected="Convergence")
policy = ConstructTransformationPolicy(
    EntropyRate=entropy_rate,
    ForceSelectionRuleForcesSet=forcesrule_2,
    NodePlacementRulePoint=nodeprule,
    ForceIndeterminaciesRuleAxialForces=forceirule)

force_s_selection_rule_3 = ValueList({"Random": 0, "ProximityToUserSelectedPoint": 1, "MinMagnitude": 2, "MaxMagnitude": 3, "Oldest": 4, "Newest": 5, "Oldest_Newest_Bi": 6, "Closest": 7, "Furthest": 8, "ClosestToDomainCentroid": 9, "FurthestToDomainCentroid": 10, "ClosestToPtCloud": 11, "FurthestToPtCloud": 12}, selected="Newest")
force_indeterminacies_rule_2 = ValueList({"Random": 0, "UserDefinedMagnitude": 1}, selected="UserDefinedMagnitude")
node_placement_rule_2 = ValueList({"Random": 0, "UserSelectedParam": 1, "UserSelectedPt": 2, "ClosestPossible": 3, "FurthestPossible": 4, "NoNode": 5}, selected="UserSelectedParam")
topological_configuration_3 = ValueList({"Inbetween": 0, "Peripheral": 1}, selected="Inbetween")
genes_2 = GenePool(Decimals=2, Maximum=10, Minimum=-10, Value=[-3.1, 3.76])
type_of_force_set_3 = ValueList({"Monomial": 0, "Binomial": 1}, selected="Binomial")
forcesrule_3 = ConstructForceSelectionRule(
    ForceSelectionRuleID=force_s_selection_rule_3,
    TypeOfForceSet=type_of_force_set_3,
    TopologicalConfiguration=topological_configuration_3,
    FlipForcesOrder=Toggle(False))
nodeprule_2 = ConstructNodePlacementRule(NodePlacementRuleID=node_placement_rule_2, MinDistanceToModel=Slider(0.25, range=0..1), TParam=Slider(0.285, range=0..1))
forceirule_2 = ConstructForceIndeterminaciesRule(ForceIndeterminaciesRuleID=force_indeterminacies_rule_2, Forces=genes_2)
entropy_rate_2 = ValueList({"Convergence": -1, "Stagnation": 0, "Divergence": 1}, selected="Convergence")
policy_2 = ConstructTransformationPolicy(
    EntropyRate=entropy_rate_2,
    ForceSelectionRuleForcesSet=forcesrule_3,
    NodePlacementRulePoint=nodeprule_2,
    ForceIndeterminaciesRuleAxialForces=forceirule_2)

force_s_selection_rule_4 = ValueList({"Random": 0, "ProximityToUserSelectedPoint": 1, "MinMagnitude": 2, "MaxMagnitude": 3, "Oldest": 4, "Newest": 5, "Oldest_Newest_Bi": 6, "Closest": 7, "Furthest": 8, "ClosestToDomainCentroid": 9, "FurthestToDomainCentroid": 10, "ClosestToPtCloud": 11, "FurthestToPtCloud": 12}, selected="Newest")
force_indeterminacies_rule_3 = ValueList({"Random": 0, "UserDefinedMagnitude": 1}, selected="UserDefinedMagnitude")
node_placement_rule_3 = ValueList({"Random": 0, "UserSelectedParam": 1, "UserSelectedPt": 2, "ClosestPossible": 3, "FurthestPossible": 4, "NoNode": 5}, selected="UserSelectedParam")
topological_configuration_4 = ValueList({"Inbetween": 0, "Peripheral": 1}, selected="Inbetween")
genes_3 = GenePool(Decimals=2, Maximum=10, Minimum=-10, Value=[-4.29, 3.76])
type_of_force_set_4 = ValueList({"Monomial": 0, "Binomial": 1}, selected="Binomial")
forcesrule_4 = ConstructForceSelectionRule(
    ForceSelectionRuleID=force_s_selection_rule_4,
    TypeOfForceSet=type_of_force_set_4,
    TopologicalConfiguration=topological_configuration_4,
    FlipForcesOrder=Toggle(True))
nodeprule_3 = ConstructNodePlacementRule(NodePlacementRuleID=node_placement_rule_3, MinDistanceToModel=Slider(0.25, range=0..1), TParam=Slider(0.71, range=0..1))
forceirule_3 = ConstructForceIndeterminaciesRule(ForceIndeterminaciesRuleID=force_indeterminacies_rule_3, Forces=genes_3)
entropy_rate_3 = ValueList({"Convergence": -1, "Stagnation": 0, "Divergence": 1}, selected="Convergence")
policy_3 = ConstructTransformationPolicy(
    EntropyRate=entropy_rate_3,
    ForceSelectionRuleForcesSet=forcesrule_4,
    NodePlacementRulePoint=nodeprule_3,
    ForceIndeterminaciesRuleAxialForces=forceirule_3)

force_s_selection_rule_5 = ValueList({"Random": 0, "ProximityToUserSelectedPoint": 1, "MinMagnitude": 2, "MaxMagnitude": 3, "Oldest": 4, "Newest": 5, "Oldest_Newest_Bi": 6, "Closest": 7, "Furthest": 8, "ClosestToDomainCentroid": 9, "FurthestToDomainCentroid": 10, "ClosestToPtCloud": 11, "FurthestToPtCloud": 12}, selected="Newest")
force_indeterminacies_rule_4 = ValueList({"Random": 0, "UserDefinedMagnitude": 1}, selected="UserDefinedMagnitude")
node_placement_rule_4 = ValueList({"Random": 0, "UserSelectedParam": 1, "UserSelectedPt": 2, "ClosestPossible": 3, "FurthestPossible": 4, "NoNode": 5}, selected="UserSelectedParam")
topological_configuration_5 = ValueList({"Inbetween": 0, "Peripheral": 1}, selected="Inbetween")
genes_4 = GenePool(Decimals=2, Maximum=10, Minimum=-10, Value=[-4.29, 3.76])
type_of_force_set_5 = ValueList({"Monomial": 0, "Binomial": 1}, selected="Binomial")
forcesrule_5 = ConstructForceSelectionRule(
    ForceSelectionRuleID=force_s_selection_rule_5,
    TypeOfForceSet=type_of_force_set_5,
    TopologicalConfiguration=topological_configuration_5,
    FlipForcesOrder=Toggle(True))
nodeprule_4 = ConstructNodePlacementRule(NodePlacementRuleID=node_placement_rule_4, MinDistanceToModel=Slider(0.25, range=0..1), TParam=Slider(0.71, range=0..1))
forceirule_4 = ConstructForceIndeterminaciesRule(ForceIndeterminaciesRuleID=force_indeterminacies_rule_4, Forces=genes_4)
entropy_rate_4 = ValueList({"Convergence": -1, "Stagnation": 0, "Divergence": 1}, selected="Convergence")
policy_4 = ConstructTransformationPolicy(
    EntropyRate=entropy_rate_4,
    ForceSelectionRuleForcesSet=forcesrule_5,
    NodePlacementRulePoint=nodeprule_4,
    ForceIndeterminaciesRuleAxialForces=forceirule_4)

# implicit force selection
# implicit node placement
# explicit force indeterminacies
# construct policy
force_s_selection_rule_6 = ValueList({"Random": 0, "ProximityToUserSelectedPoint": 1, "MinMagnitude": 2, "MaxMagnitude": 3, "Oldest": 4, "Newest": 5, "Oldest_Newest_Bi": 6, "Closest": 7, "Furthest": 8, "ClosestToDomainCentroid": 9, "FurthestToDomainCentroid": 10, "ClosestToPtCloud": 11, "FurthestToPtCloud": 12}, selected="Oldest")
force_indeterminacies_rule_5 = ValueList({"Random": 0, "UserDefinedMagnitude": 1}, selected="UserDefinedMagnitude")
node_placement_rule_5 = ValueList({"Random": 0, "UserSelectedParam": 1, "UserSelectedPt": 2, "ClosestPossible": 3, "FurthestPossible": 4, "NoNode": 5}, selected="UserSelectedParam")
topological_configuration_6 = ValueList({"Inbetween": 0, "Peripheral": 1}, selected="Inbetween")
genes_5 = GenePool(Decimals=2, Maximum=10, Minimum=-10, Value=[2.29, 3.910474774])
type_of_force_set_6 = ValueList({"Monomial": 0, "Binomial": 1}, selected="Binomial")
forcesrule_6 = ConstructForceSelectionRule(
    ForceSelectionRuleID=force_s_selection_rule_6,
    TypeOfForceSet=type_of_force_set_6,
    TopologicalConfiguration=topological_configuration_6,
    FlipForcesOrder=Toggle(False))
nodeprule_5 = ConstructNodePlacementRule(NodePlacementRuleID=node_placement_rule_5, MinDistanceToModel=Slider(0.25, range=0..1), TParam=Slider(0.144, range=0..1))
forceirule_5 = ConstructForceIndeterminaciesRule(ForceIndeterminaciesRuleID=force_indeterminacies_rule_5, Forces=genes_5)
entropy_rate_5 = ValueList({"Convergence": -1, "Stagnation": 0, "Divergence": 1}, selected="Convergence")
policy_5 = ConstructTransformationPolicy(
    EntropyRate=entropy_rate_5,
    ForceSelectionRuleForcesSet=forcesrule_6,
    NodePlacementRulePoint=nodeprule_5,
    ForceIndeterminaciesRuleAxialForces=forceirule_5)

# ----
force_indeterminacies_rule_6 = ValueList({"Random": 0, "UserDefinedMagnitude": 1}, selected="UserDefinedMagnitude")
node_placement_rule_6 = ValueList({"Random": 0, "UserSelectedParam": 1, "UserSelectedPt": 2, "ClosestPossible": 3, "FurthestPossible": 4, "NoNode": 5}, selected="UserSelectedParam")
genes_6 = GenePool(Decimals=2, Maximum=10, Minimum=-10, Value=[-3.57, 3.76])
nodeprule_6 = ConstructNodePlacementRule(NodePlacementRuleID=node_placement_rule_6, MinDistanceToModel=Slider(0.25, range=0..1), TParam=Slider(0.28, range=0..1))
forceirule_6 = ConstructForceIndeterminaciesRule(ForceIndeterminaciesRuleID=force_indeterminacies_rule_6, Forces=genes_6)
entropy_rate_6 = ValueList({"Convergence": -1, "Stagnation": 0, "Divergence": 1}, selected="Stagnation")
policy_6 = ConstructTransformationPolicy(
    EntropyRate=entropy_rate_6,
    ForceSelectionRuleForcesSet=forcesrule,
    NodePlacementRulePoint=nodeprule_6,
    ForceIndeterminaciesRuleAxialForces=forceirule_6)

# ----
# explicit node placement
node_placement_rule_7 = ValueList({"Random": 0, "UserSelectedParam": 1, "UserSelectedPt": 2, "ClosestPossible": 3, "FurthestPossible": 4, "NoNode": 5}, selected="UserSelectedPt")
pt_11 = Point(<point referenced from the Rhino model>)
nodeprule_7 = ConstructNodePlacementRule(NodePlacementRuleID=node_placement_rule_7, MinDistanceToModel=Slider(0.25, range=0..1), NewPoint=pt_11)

# ----
# apply policy transformation
number_slider = Slider(1, range=1..10)
transform = ApplyTransformationPolicy(Iterations=number_slider, Model=constructmodel, Policy=policy_5, fa=True)

transform_2 = ApplyTransformationPolicy(Iterations=Slider(1, range=1..10), Model=transform, Policy=policy_6, fa=True)

force_indeterminacies_rule_7 = ValueList({"Random": 0, "UserDefinedMagnitude": 1}, selected="UserDefinedMagnitude")
node_placement_rule_8 = ValueList({"Random": 0, "UserSelectedParam": 1, "UserSelectedPt": 2, "ClosestPossible": 3, "FurthestPossible": 4, "NoNode": 5}, selected="UserSelectedParam")
genes_7 = GenePool(Decimals=2, Maximum=10, Minimum=-10, Value=[2.51, 3.76])
nodeprule_8 = ConstructNodePlacementRule(NodePlacementRuleID=node_placement_rule_8, MinDistanceToModel=Slider(0.25, range=0..1), TParam=Slider(0.41, range=0..1))
forceirule_7 = ConstructForceIndeterminaciesRule(ForceIndeterminaciesRuleID=force_indeterminacies_rule_7, Forces=genes_7)
entropy_rate_7 = ValueList({"Convergence": -1, "Stagnation": 0, "Divergence": 1}, selected="Stagnation")
policy_7 = ConstructTransformationPolicy(
    EntropyRate=entropy_rate_7,
    ForceSelectionRuleForcesSet=forcesrule,
    NodePlacementRulePoint=nodeprule_8,
    ForceIndeterminaciesRuleAxialForces=forceirule_7)
transform_3 = ApplyTransformationPolicy(Iterations=Slider(1, range=1..10), Model=transform_2, Policy=policy_7, fa=True)

force_indeterminacies_rule_8 = ValueList({"Random": 0, "UserDefinedMagnitude": 1}, selected="UserDefinedMagnitude")
node_placement_rule_9 = ValueList({"Random": 0, "UserSelectedParam": 1, "UserSelectedPt": 2, "ClosestPossible": 3, "FurthestPossible": 4, "NoNode": 5}, selected="UserSelectedParam")
genes_8 = GenePool(Decimals=2, Maximum=10, Minimum=-10, Value=[-0.14, 3.76])
nodeprule_9 = ConstructNodePlacementRule(NodePlacementRuleID=node_placement_rule_9, MinDistanceToModel=Slider(0.25, range=0..1), TParam=Slider(0.504, range=0..1))
forceirule_8 = ConstructForceIndeterminaciesRule(ForceIndeterminaciesRuleID=force_indeterminacies_rule_8, Forces=genes_8)
entropy_rate_8 = ValueList({"Convergence": -1, "Stagnation": 0, "Divergence": 1}, selected="Stagnation")
policy_8 = ConstructTransformationPolicy(
    EntropyRate=entropy_rate_8,
    ForceSelectionRuleForcesSet=forcesrule,
    NodePlacementRulePoint=nodeprule_9,
    ForceIndeterminaciesRuleAxialForces=forceirule_8)
transform_4 = ApplyTransformationPolicy(Iterations=Slider(1, range=1..10), Model=transform_3, Policy=policy_8, fa=True)

force_indeterminacies_rule_9 = ValueList({"Random": 0, "UserDefinedMagnitude": 1}, selected="UserDefinedMagnitude")
node_placement_rule_10 = ValueList({"Random": 0, "UserSelectedParam": 1, "UserSelectedPt": 2, "ClosestPossible": 3, "FurthestPossible": 4, "NoNode": 5}, selected="UserSelectedParam")
genes_9 = GenePool(Decimals=2, Maximum=10, Minimum=-10, Value=[-0.61, 3.76])
nodeprule_10 = ConstructNodePlacementRule(
    NodePlacementRuleID=node_placement_rule_10,
    MinDistanceToModel=Slider(0.25, range=0..1),
    TParam=Slider(0.414, range=0..1))
forceirule_9 = ConstructForceIndeterminaciesRule(ForceIndeterminaciesRuleID=force_indeterminacies_rule_9, Forces=genes_9)
entropy_rate_9 = ValueList({"Convergence": -1, "Stagnation": 0, "Divergence": 1}, selected="Stagnation")
policy_9 = ConstructTransformationPolicy(
    EntropyRate=entropy_rate_9,
    ForceSelectionRuleForcesSet=forcesrule,
    NodePlacementRulePoint=nodeprule_10,
    ForceIndeterminaciesRuleAxialForces=forceirule_9)
transform_5 = ApplyTransformationPolicy(Iterations=Slider(1, range=1..10), Model=transform_4, Policy=policy_9, fa=True)

force_indeterminacies_rule_10 = ValueList({"Random": 0, "UserDefinedMagnitude": 1}, selected="UserDefinedMagnitude")
node_placement_rule_11 = ValueList({"Random": 0, "UserSelectedParam": 1, "UserSelectedPt": 2, "ClosestPossible": 3, "FurthestPossible": 4, "NoNode": 5}, selected="UserSelectedParam")
genes_10 = GenePool(Decimals=2, Maximum=10, Minimum=-10, Value=[-0.61, 3.76])
nodeprule_11 = ConstructNodePlacementRule(
    NodePlacementRuleID=node_placement_rule_11,
    MinDistanceToModel=Slider(0.25, range=0..1),
    TParam=Slider(0.414, range=0..1))
forceirule_10 = ConstructForceIndeterminaciesRule(ForceIndeterminaciesRuleID=force_indeterminacies_rule_10, Forces=genes_10)
entropy_rate_10 = ValueList({"Convergence": -1, "Stagnation": 0, "Divergence": 1}, selected="Convergence")
policy_10 = ConstructTransformationPolicy(
    EntropyRate=entropy_rate_10,
    ForceSelectionRuleForcesSet=forcesrule,
    NodePlacementRulePoint=nodeprule_11,
    ForceIndeterminaciesRuleAxialForces=forceirule_10)
transform_6 = ApplyTransformationPolicy(Iterations=Slider(1, range=1..10), Model=transform_5, Policy=policy_10, fa=True)

# ----
# explicit force selection
number_slider_2 = Slider(0.062, range=0..1)
topological_configuration_7 = ValueList({"Inbetween": 0, "Peripheral": 1}, selected="Inbetween")
selectforce = SelectForce(Model=transform_6, Identifier=number_slider_2)  # -> ForceObject, ForceName, AnchorPoint, ForceDirection, ForceMagnitude
selectforce_2 = SelectForce(Model=transform_6, Identifier=Slider(1, range=0..1))  # -> ForceObject, ForceName, AnchorPoint, ForceDirection, ForceMagnitude
entropy_rate_11 = ValueList({"Convergence": -1, "Stagnation": 0, "Divergence": 1}, selected="Divergence")
constructforceset = ConstructForceSet(
    EntropyRate=entropy_rate_11,
    TopologicalConfiguration=topological_configuration_7,
    Model=transform_6,
    ForceObjectS=[selectforce.ForceObject, selectforce_2.ForceObject])  # -> IsValid, ForceSet, EntropyRateDomain, ConstructabilityDomain, ConstrainedDomain

force_indeterminacies_rule_11 = ValueList({"Random": 0, "UserDefinedMagnitude": 1}, selected="UserDefinedMagnitude")
genes_11 = GenePool(Decimals=2, Maximum=10, Minimum=-10, Value=[-6.98, -3.33])
forceirule_11 = ConstructForceIndeterminaciesRule(ForceIndeterminaciesRuleID=force_indeterminacies_rule_11, Forces=genes_11)
policy_11 = ConstructTransformationPolicy(
    EntropyRate=entropy_rate_11,
    ForceSelectionRuleForcesSet=constructforceset.ForceSet,
    NodePlacementRulePoint=nodeprule_7,
    ForceIndeterminaciesRuleAxialForces=forceirule_11)

transform_7 = ApplyTransformationPolicy(Iterations=Slider(1, range=1..10), Model=transform_6, Policy=policy_11, fa=True)

force_indeterminacies_rule_12 = ValueList({"Random": 0, "UserDefinedMagnitude": 1}, selected="UserDefinedMagnitude")
node_placement_rule_12 = ValueList({"Random": 0, "UserSelectedParam": 1, "UserSelectedPt": 2, "ClosestPossible": 3, "FurthestPossible": 4, "NoNode": 5}, selected="UserSelectedParam")
topological_configuration_8 = ValueList({"Inbetween": 0, "Peripheral": 1}, selected="Inbetween")
selectforce_3 = SelectForce(Model=transform_7, Identifier=Slider(0.744, range=0..1))  # -> ForceObject, ForceName, AnchorPoint, ForceDirection, ForceMagnitude
selectforce_4 = SelectForce(Model=transform_7, Identifier=Slider(0.408, range=0..1))  # -> ForceObject, ForceName, AnchorPoint, ForceDirection, ForceMagnitude
genes_12 = GenePool(Decimals=2, Maximum=10, Minimum=-10, Value=[-0.84, 3.76])
entropy_rate_12 = ValueList({"Convergence": -1, "Stagnation": 0, "Divergence": 1}, selected="Convergence")
constructforceset_2 = ConstructForceSet(
    EntropyRate=entropy_rate_12,
    TopologicalConfiguration=topological_configuration_8,
    Model=transform_7,
    ForceObjectS=[selectforce_3.ForceObject, selectforce_4.ForceObject])  # -> IsValid, ForceSet, EntropyRateDomain, ConstructabilityDomain, ConstrainedDomain
nodeprule_12 = ConstructNodePlacementRule(
    NodePlacementRuleID=node_placement_rule_12,
    MinDistanceToModel=Slider(0.25, range=0..1),
    TParam=Slider(0.414, range=0..1))
forceirule_12 = ConstructForceIndeterminaciesRule(ForceIndeterminaciesRuleID=force_indeterminacies_rule_12, Forces=genes_12)
policy_12 = ConstructTransformationPolicy(
    EntropyRate=entropy_rate_12,
    ForceSelectionRuleForcesSet=constructforceset_2.ForceSet,
    NodePlacementRulePoint=nodeprule_12,
    ForceIndeterminaciesRuleAxialForces=forceirule_12)

transform_8 = ApplyTransformationPolicy(Iterations=Slider(1, range=1..10), Model=transform_7, Policy=policy_12, fa=True)

transform_9 = ApplyTransformationPolicy(Iterations=Slider(1, range=1..10), Model=transform_8, Policy=policy, fa=True)

transform_10 = ApplyTransformationPolicy(Iterations=Slider(1, range=1..10), Model=transform_9, Policy=policy_2, fa=True)

transform_11 = ApplyTransformationPolicy(Iterations=Slider(1, range=1..10), Model=transform_10, Policy=policy_3, fa=True)

transform_12 = ApplyTransformationPolicy(Iterations=Slider(2, range=1..10), Model=transform_11, Policy=policy_4, fa=True)

genes_13 = GenePool(Decimals=2, Maximum=5, Minimum=0, Value=[2, 2, 1.5, 1, 1.5, 2, 5, 1.5])
pt_12 = Point(Point(25, -10, 0))
xy = XYPlane(Origin=pt_12)
modelhistory = ModelHistory(Model=transform_12, Iteration=-1)  # -> Rule_ForceS, Rule_NodeP, Rule_ForceI, Rule_EntR_des, RuleEntR_app, ForceSet, Point, ForceMagnitude, Force
modelmetrics = ModelMetricsText(Model=transform_12)  # -> AllMetrics, StaticAction, NumberOfBars, NumberOfNodes, NumberOfIntersectingBars, NumberOfInterimForces, MinBarLength, MaxBarLength, MinForceMagnitude, MaxForceMagnitude
modelspidergraph = ModelMetricsSpiderGraph(
    Model=transform_12,
    GraphPlane=xy,
    GraphWeight=genes_13,
    GraphScale=1,
    TextHeight=Slider(0.5, range=0..1),
    VerticalDistance=Slider(0.561, range=0..1),
    RadialDistance=Slider(0.309, range=0..1))  # -> GraphLines, MetricsLine, Text
panel = Panel(modelhistory.RuleEntR_app)
panel_2 = Panel(modelmetrics.AllMetrics)
pipe = Pipe(Curve=modelspidergraph.MetricsLine, Radius=Slider(0.119, range=0..1), Caps=0)
