# Grasshopper definition symmetric_pylon_transformation[completed].gh (Grasshopper 1.0.7)
# plug-ins: Libra

pt = Point(<point referenced from the Rhino model>)
pt_2 = Point(<point referenced from the Rhino model>)
pt_3 = Point(<point referenced from the Rhino model>)
pt_4 = Point(<point referenced from the Rhino model>)
pt_5 = Point(<point referenced from the Rhino model>)
pt_6 = Point(<point referenced from the Rhino model>)
pt_7 = Point(<point referenced from the Rhino model>)
pt_8 = Point(<point referenced from the Rhino model>)
pt_9 = Point(<point referenced from the Rhino model>)
pt_10 = Point(<point referenced from the Rhino model>)
pt_11 = Point(<point referenced from the Rhino model>)
pt_12 = Point(<point referenced from the Rhino model>)
pt_13 = Point(<point referenced from the Rhino model>)
pt_14 = Point(<point referenced from the Rhino model>)
pt_15 = Point(<point referenced from the Rhino model>)
pt_16 = Point(<point referenced from the Rhino model>)
vec2pt = Vector2Pt(PointA=pt, PointB=pt_2, Unitize=False)  # -> Vector, Length
vec2pt_2 = Vector2Pt(PointA=pt_3, PointB=pt_4, Unitize=False)  # -> Vector, Length
vec2pt_3 = Vector2Pt(PointA=pt_5, PointB=pt_6, Unitize=False)  # -> Vector, Length
vec2pt_4 = Vector2Pt(PointA=pt_7, PointB=pt_8, Unitize=False)  # -> Vector, Length
vec2pt_5 = Vector2Pt(PointA=pt_9, PointB=pt_10, Unitize=False)  # -> Vector, Length
vec2pt_6 = Vector2Pt(PointA=pt_11, PointB=pt_12, Unitize=False)  # -> Vector, Length
vec2pt_7 = Vector2Pt(PointA=pt_13, PointB=pt_14, Unitize=False)  # -> Vector, Length
vec2pt_8 = Vector2Pt(PointA=pt_15, PointB=pt_16, Unitize=False)  # -> Vector, Length
crv = Curve(<curve referenced from the Rhino model>)
builddomain = BuildDomain(RegionsIn=crv)
merge = Merge(Data1=pt_2, Data2=pt_4, Data3=pt_6, Data4=pt_8, Data5=pt_10, Data6=pt_12, Data7=pt_14, Data8=pt_16)
merge_2 = Merge(
    Data1=vec2pt.Vector,
    Data2=vec2pt_2.Vector,
    Data3=vec2pt_3.Vector,
    Data4=vec2pt_4.Vector,
    Data5=vec2pt_5.Vector,
    Data6=vec2pt_6.Vector,
    Data7=vec2pt_7.Vector,
    Data8=vec2pt_8.Vector)
buildmodel = BuildModelWithVectors(AnchorNode=merge, ForceVector=merge_2, DesignDomain=builddomain)

force_indeterminacies_rule = ValueList({"Random": 0, "UserDefinedMagnitude": 1}, selected="UserDefinedMagnitude")
node_placement_rule = ValueList({"Random": 0, "UserSelectedParam": 1, "UserSelectedPt": 2, "ClosestPossible": 3, "FurthestPossible": 4, "NoNode": 5}, selected="UserSelectedParam")
topological_configuration = ValueList({"Inbetween": 0, "Peripheral": 1}, selected="Inbetween")
selectforce = SelectForce(Model=buildmodel, Identifier=Slider(0.114, range=0..1))  # -> ForceObject, ForceName, AnchorPoint, ForceDirection, ForceMagnitude
selectforce_2 = SelectForce(Model=buildmodel, Identifier=Slider(0, range=0..1))  # -> ForceObject, ForceName, AnchorPoint, ForceDirection, ForceMagnitude
genes = GenePool(Decimals=2, Maximum=20, Minimum=-20, Value=[3.27, -0.16])
entropy_rate = ValueList({"Convergence": -1, "Stagnation": 0, "Divergence": 1}, selected="Stagnation")
constructforceset = ConstructForceSet(
    EntropyRate=entropy_rate,
    TopologicalConfiguration=topological_configuration,
    Model=buildmodel,
    ForceObjectS=[selectforce.ForceObject, selectforce_2.ForceObject])  # -> IsValid, ForceSet, EntropyRateDomain, ConstructabilityDomain, ConstrainedDomain
nodeprule = ConstructNodePlacementRule(NodePlacementRuleID=node_placement_rule, MinDistanceToModel=Slider(0.25, range=0..1), TParam=Slider(0.257, range=0..1))
forceirule = ConstructForceIndeterminaciesRule(ForceIndeterminaciesRuleID=force_indeterminacies_rule, Forces=genes)
policy = ConstructTransformationPolicy(
    EntropyRate=entropy_rate,
    ForceSelectionRuleForcesSet=constructforceset.ForceSet,
    NodePlacementRulePoint=nodeprule,
    ForceIndeterminaciesRuleAxialForces=forceirule)
transform = ApplyTransformationPolicy(Iterations=Slider(1, range=1..10), Model=buildmodel, Policy=policy, fa=True)

force_indeterminacies_rule_2 = ValueList({"Random": 0, "UserDefinedMagnitude": 1}, selected="UserDefinedMagnitude")
node_placement_rule_2 = ValueList({"Random": 0, "UserSelectedParam": 1, "UserSelectedPt": 2, "ClosestPossible": 3, "FurthestPossible": 4, "NoNode": 5}, selected="UserSelectedParam")
topological_configuration_2 = ValueList({"Inbetween": 0, "Peripheral": 1}, selected="Inbetween")
selectforce_3 = SelectForce(Model=transform, Identifier=Slider(1, range=0..1))  # -> ForceObject, ForceName, AnchorPoint, ForceDirection, ForceMagnitude
selectforce_4 = SelectForce(Model=transform, Identifier=Slider(0.9, range=0..1))  # -> ForceObject, ForceName, AnchorPoint, ForceDirection, ForceMagnitude
genes_2 = GenePool(Decimals=2, Maximum=20, Minimum=-20, Value=[3.27, -0.16])
entropy_rate_2 = ValueList({"Convergence": -1, "Stagnation": 0, "Divergence": 1}, selected="Convergence")
constructforceset_2 = ConstructForceSet(
    EntropyRate=entropy_rate_2,
    TopologicalConfiguration=topological_configuration_2,
    Model=transform,
    ForceObjectS=[selectforce_3.ForceObject, selectforce_4.ForceObject])  # -> IsValid, ForceSet, EntropyRateDomain, ConstructabilityDomain, ConstrainedDomain
nodeprule_2 = ConstructNodePlacementRule(NodePlacementRuleID=node_placement_rule_2, MinDistanceToModel=Slider(0.25, range=0..1), TParam=Slider(0.257, range=0..1))
forceirule_2 = ConstructForceIndeterminaciesRule(ForceIndeterminaciesRuleID=force_indeterminacies_rule_2, Forces=genes_2)
policy_2 = ConstructTransformationPolicy(
    EntropyRate=entropy_rate_2,
    ForceSelectionRuleForcesSet=constructforceset_2.ForceSet,
    NodePlacementRulePoint=nodeprule_2,
    ForceIndeterminaciesRuleAxialForces=forceirule_2)
transform_2 = ApplyTransformationPolicy(Iterations=Slider(1, range=1..10), Model=transform, Policy=policy_2, fa=True)

force_indeterminacies_rule_3 = ValueList({"Random": 0, "UserDefinedMagnitude": 1}, selected="UserDefinedMagnitude")
node_placement_rule_3 = ValueList({"Random": 0, "UserSelectedParam": 1, "UserSelectedPt": 2, "ClosestPossible": 3, "FurthestPossible": 4, "NoNode": 5}, selected="UserSelectedParam")
topological_configuration_3 = ValueList({"Inbetween": 0, "Peripheral": 1}, selected="Inbetween")
selectforce_5 = SelectForce(Model=transform_2, Identifier=Slider(1, range=0..1))  # -> ForceObject, ForceName, AnchorPoint, ForceDirection, ForceMagnitude
selectforce_6 = SelectForce(Model=transform_2, Identifier=Slider(0.9, range=0..1))  # -> ForceObject, ForceName, AnchorPoint, ForceDirection, ForceMagnitude
genes_3 = GenePool(Decimals=2, Maximum=20, Minimum=-20, Value=[0.87, 7.64])
entropy_rate_3 = ValueList({"Convergence": -1, "Stagnation": 0, "Divergence": 1}, selected="Stagnation")
constructforceset_3 = ConstructForceSet(
    EntropyRate=entropy_rate_3,
    TopologicalConfiguration=topological_configuration_3,
    Model=transform_2,
    ForceObjectS=[selectforce_5.ForceObject, selectforce_6.ForceObject])  # -> IsValid, ForceSet, EntropyRateDomain, ConstructabilityDomain, ConstrainedDomain
nodeprule_3 = ConstructNodePlacementRule(NodePlacementRuleID=node_placement_rule_3, MinDistanceToModel=Slider(0.25, range=0..1), TParam=Slider(0.285, range=0..1))
forceirule_3 = ConstructForceIndeterminaciesRule(ForceIndeterminaciesRuleID=force_indeterminacies_rule_3, Forces=genes_3)
policy_3 = ConstructTransformationPolicy(
    EntropyRate=entropy_rate_3,
    ForceSelectionRuleForcesSet=constructforceset_3.ForceSet,
    NodePlacementRulePoint=nodeprule_3,
    ForceIndeterminaciesRuleAxialForces=forceirule_3)
transform_3 = ApplyTransformationPolicy(Iterations=Slider(1, range=1..10), Model=transform_2, Policy=policy_3, fa=True)

force_indeterminacies_rule_4 = ValueList({"Random": 0, "UserDefinedMagnitude": 1}, selected="UserDefinedMagnitude")
node_placement_rule_4 = ValueList({"Random": 0, "UserSelectedParam": 1, "UserSelectedPt": 2, "ClosestPossible": 3, "FurthestPossible": 4, "NoNode": 5}, selected="UserSelectedParam")
topological_configuration_4 = ValueList({"Inbetween": 0, "Peripheral": 1}, selected="Inbetween")
selectforce_7 = SelectForce(Model=transform_3, Identifier=Slider(1, range=0..1))  # -> ForceObject, ForceName, AnchorPoint, ForceDirection, ForceMagnitude
selectforce_8 = SelectForce(Model=transform_3, Identifier=Slider(0.9, range=0..1))  # -> ForceObject, ForceName, AnchorPoint, ForceDirection, ForceMagnitude
genes_4 = GenePool(Decimals=2, Maximum=20, Minimum=-20, Value=[0.87, 7.64])
entropy_rate_4 = ValueList({"Convergence": -1, "Stagnation": 0, "Divergence": 1}, selected="Convergence")
constructforceset_4 = ConstructForceSet(
    EntropyRate=entropy_rate_4,
    TopologicalConfiguration=topological_configuration_4,
    Model=transform_3,
    ForceObjectS=[selectforce_7.ForceObject, selectforce_8.ForceObject])  # -> IsValid, ForceSet, EntropyRateDomain, ConstructabilityDomain, ConstrainedDomain
nodeprule_4 = ConstructNodePlacementRule(NodePlacementRuleID=node_placement_rule_4, MinDistanceToModel=Slider(0.25, range=0..1), TParam=Slider(0.285, range=0..1))
forceirule_4 = ConstructForceIndeterminaciesRule(ForceIndeterminaciesRuleID=force_indeterminacies_rule_4, Forces=genes_4)
policy_4 = ConstructTransformationPolicy(
    EntropyRate=entropy_rate_4,
    ForceSelectionRuleForcesSet=constructforceset_4.ForceSet,
    NodePlacementRulePoint=nodeprule_4,
    ForceIndeterminaciesRuleAxialForces=forceirule_4)
transform_4 = ApplyTransformationPolicy(Iterations=Slider(1, range=1..10), Model=transform_3, Policy=policy_4, fa=True)

# ---- group: Transformation Policy Parameters
force_s_selection_rule = ValueList({"Random": 0, "ProximityToUserSelectedPoint": 1, "MinMagnitude": 2, "MaxMagnitude": 3, "Oldest": 4, "Newest": 5, "Oldest_Newest_Bi": 6, "Closest": 7, "Furthest": 8, "ClosestToDomainCentroid": 9, "FurthestToDomainCentroid": 10, "ClosestToPtCloud": 11, "FurthestToPtCloud": 12}, selected="Newest")
force_indeterminacies_rule_5 = ValueList({"Random": 0, "UserDefinedMagnitude": 1}, selected="UserDefinedMagnitude")
node_placement_rule_5 = ValueList({"Random": 0, "UserSelectedParam": 1, "UserSelectedPt": 2, "ClosestPossible": 3, "FurthestPossible": 4, "NoNode": 5}, selected="UserSelectedParam")
topological_configuration_5 = ValueList({"Inbetween": 0, "Peripheral": 1}, selected="Inbetween")
type_of_force_set = ValueList({"Monomial": 0, "Binomial": 1}, selected="Binomial")
genes_5 = GenePool(Decimals=2, Maximum=20, Minimum=-20, Value=[3.58, 0.22])
forcesrule = ConstructForceSelectionRule(
    ForceSelectionRuleID=force_s_selection_rule,
    TypeOfForceSet=type_of_force_set,
    TopologicalConfiguration=topological_configuration_5,
    FlipForcesOrder=Toggle(False))
nodeprule_5 = ConstructNodePlacementRule(NodePlacementRuleID=node_placement_rule_5, MinDistanceToModel=Slider(0.25, range=0..1), TParam=Slider(0.25, range=0..1))
forceirule_5 = ConstructForceIndeterminaciesRule(ForceIndeterminaciesRuleID=force_indeterminacies_rule_5, Forces=genes_5)
entropy_rate_5 = ValueList({"Convergence": -1, "Stagnation": 0, "Divergence": 1}, selected="Convergence")
policy_5 = ConstructTransformationPolicy(
    EntropyRate=entropy_rate_5,
    ForceSelectionRuleForcesSet=forcesrule,
    NodePlacementRulePoint=nodeprule_5,
    ForceIndeterminaciesRuleAxialForces=forceirule_5)

# ----
pt_17 = Point(<point referenced from the Rhino model>)

force_indeterminacies_rule_6 = ValueList({"Random": 0, "UserDefinedMagnitude": 1}, selected="UserDefinedMagnitude")
node_placement_rule_6 = ValueList({"Random": 0, "UserSelectedParam": 1, "UserSelectedPt": 2, "ClosestPossible": 3, "FurthestPossible": 4, "NoNode": 5}, selected="UserSelectedPt")
topological_configuration_6 = ValueList({"Inbetween": 0, "Peripheral": 1}, selected="Inbetween")
selectforce_9 = SelectForce(Model=transform_4, Identifier=Slider(1, range=0..1))  # -> ForceObject, ForceName, AnchorPoint, ForceDirection, ForceMagnitude
selectforce_10 = SelectForce(Model=transform_4, Identifier=Slider(0, range=0..1))  # -> ForceObject, ForceName, AnchorPoint, ForceDirection, ForceMagnitude
genes_6 = GenePool(Decimals=2, Maximum=20, Minimum=-20, Value=[1.76, -4.18])
entropy_rate_6 = ValueList({"Convergence": -1, "Stagnation": 0, "Divergence": 1}, selected="Divergence")
constructforceset_5 = ConstructForceSet(
    EntropyRate=entropy_rate_6,
    TopologicalConfiguration=topological_configuration_6,
    Model=transform_4,
    ForceObjectS=[selectforce_9.ForceObject, selectforce_10.ForceObject])  # -> IsValid, ForceSet, EntropyRateDomain, ConstructabilityDomain, ConstrainedDomain
nodeprule_6 = ConstructNodePlacementRule(NodePlacementRuleID=node_placement_rule_6, MinDistanceToModel=Slider(0.25, range=0..1), NewPoint=pt_17)
forceirule_6 = ConstructForceIndeterminaciesRule(ForceIndeterminaciesRuleID=force_indeterminacies_rule_6, Forces=genes_6)
policy_6 = ConstructTransformationPolicy(
    EntropyRate=entropy_rate_6,
    ForceSelectionRuleForcesSet=constructforceset_5.ForceSet,
    NodePlacementRulePoint=nodeprule_6,
    ForceIndeterminaciesRuleAxialForces=forceirule_6)
transform_5 = ApplyTransformationPolicy(Iterations=Slider(1, range=1..10), Model=transform_4, Policy=policy_6, fa=True)

pt_18 = Point(<point referenced from the Rhino model>)

force_indeterminacies_rule_7 = ValueList({"Random": 0, "UserDefinedMagnitude": 1}, selected="UserDefinedMagnitude")
node_placement_rule_7 = ValueList({"Random": 0, "UserSelectedParam": 1, "UserSelectedPt": 2, "ClosestPossible": 3, "FurthestPossible": 4, "NoNode": 5}, selected="UserSelectedPt")
topological_configuration_7 = ValueList({"Inbetween": 0, "Peripheral": 1}, selected="Inbetween")
selectforce_11 = SelectForce(Model=transform_5, Identifier=Slider(0.776, range=0..1))  # -> ForceObject, ForceName, AnchorPoint, ForceDirection, ForceMagnitude
selectforce_12 = SelectForce(Model=transform_5, Identifier=Slider(0.706, range=0..1))  # -> ForceObject, ForceName, AnchorPoint, ForceDirection, ForceMagnitude
genes_7 = GenePool(Decimals=2, Maximum=20, Minimum=-20, Value=[1.76, -4.18])
entropy_rate_7 = ValueList({"Convergence": -1, "Stagnation": 0, "Divergence": 1}, selected="Convergence")
constructforceset_6 = ConstructForceSet(
    EntropyRate=entropy_rate_7,
    TopologicalConfiguration=topological_configuration_7,
    Model=transform_5,
    ForceObjectS=[selectforce_11.ForceObject, selectforce_12.ForceObject])  # -> IsValid, ForceSet, EntropyRateDomain, ConstructabilityDomain, ConstrainedDomain
nodeprule_7 = ConstructNodePlacementRule(NodePlacementRuleID=node_placement_rule_7, MinDistanceToModel=Slider(0.25, range=0..1), NewPoint=pt_18)
forceirule_7 = ConstructForceIndeterminaciesRule(ForceIndeterminaciesRuleID=force_indeterminacies_rule_7, Forces=genes_7)
policy_7 = ConstructTransformationPolicy(
    EntropyRate=entropy_rate_7,
    ForceSelectionRuleForcesSet=constructforceset_6.ForceSet,
    NodePlacementRulePoint=nodeprule_7,
    ForceIndeterminaciesRuleAxialForces=forceirule_7)
transform_6 = ApplyTransformationPolicy(Iterations=Slider(1, range=1..10), Model=transform_5, Policy=policy_7, fa=True)

force_indeterminacies_rule_8 = ValueList({"Random": 0, "UserDefinedMagnitude": 1}, selected="UserDefinedMagnitude")
node_placement_rule_8 = ValueList({"Random": 0, "UserSelectedParam": 1, "UserSelectedPt": 2, "ClosestPossible": 3, "FurthestPossible": 4, "NoNode": 5}, selected="UserSelectedParam")
topological_configuration_8 = ValueList({"Inbetween": 0, "Peripheral": 1}, selected="Inbetween")
selectforce_13 = SelectForce(Model=transform_6, Identifier=Slider(0.776, range=0..1))  # -> ForceObject, ForceName, AnchorPoint, ForceDirection, ForceMagnitude
selectforce_14 = SelectForce(Model=transform_6, Identifier=Slider(0.902, range=0..1))  # -> ForceObject, ForceName, AnchorPoint, ForceDirection, ForceMagnitude
genes_8 = GenePool(Decimals=2, Maximum=20, Minimum=-20, Value=[4.34, 1.49])
entropy_rate_8 = ValueList({"Convergence": -1, "Stagnation": 0, "Divergence": 1}, selected="Stagnation")
constructforceset_7 = ConstructForceSet(
    EntropyRate=entropy_rate_8,
    TopologicalConfiguration=topological_configuration_8,
    Model=transform_6,
    ForceObjectS=[selectforce_13.ForceObject, selectforce_14.ForceObject])  # -> IsValid, ForceSet, EntropyRateDomain, ConstructabilityDomain, ConstrainedDomain
nodeprule_8 = ConstructNodePlacementRule(NodePlacementRuleID=node_placement_rule_8, MinDistanceToModel=Slider(0.25, range=0..1), TParam=Slider(0.68, range=0..1))
forceirule_8 = ConstructForceIndeterminaciesRule(ForceIndeterminaciesRuleID=force_indeterminacies_rule_8, Forces=genes_8)
policy_8 = ConstructTransformationPolicy(
    EntropyRate=entropy_rate_8,
    ForceSelectionRuleForcesSet=constructforceset_7.ForceSet,
    NodePlacementRulePoint=nodeprule_8,
    ForceIndeterminaciesRuleAxialForces=forceirule_8)
transform_7 = ApplyTransformationPolicy(Iterations=Slider(1, range=1..10), Model=transform_6, Policy=policy_8, fa=True)

force_indeterminacies_rule_9 = ValueList({"Random": 0, "UserDefinedMagnitude": 1}, selected="UserDefinedMagnitude")
node_placement_rule_9 = ValueList({"Random": 0, "UserSelectedParam": 1, "UserSelectedPt": 2, "ClosestPossible": 3, "FurthestPossible": 4, "NoNode": 5}, selected="UserSelectedParam")
topological_configuration_9 = ValueList({"Inbetween": 0, "Peripheral": 1}, selected="Inbetween")
selectforce_15 = SelectForce(Model=transform_7, Identifier=Slider(1, range=0..1))  # -> ForceObject, ForceName, AnchorPoint, ForceDirection, ForceMagnitude
selectforce_16 = SelectForce(Model=transform_7, Identifier=Slider(0.631, range=0..1))  # -> ForceObject, ForceName, AnchorPoint, ForceDirection, ForceMagnitude
genes_9 = GenePool(Decimals=2, Maximum=20, Minimum=-20, Value=[4.34, 1.49])
entropy_rate_9 = ValueList({"Convergence": -1, "Stagnation": 0, "Divergence": 1}, selected="Convergence")
constructforceset_8 = ConstructForceSet(
    EntropyRate=entropy_rate_9,
    TopologicalConfiguration=topological_configuration_9,
    Model=transform_7,
    ForceObjectS=[selectforce_15.ForceObject, selectforce_16.ForceObject])  # -> IsValid, ForceSet, EntropyRateDomain, ConstructabilityDomain, ConstrainedDomain
nodeprule_9 = ConstructNodePlacementRule(NodePlacementRuleID=node_placement_rule_9, MinDistanceToModel=Slider(0.25, range=0..1), TParam=Slider(0.68, range=0..1))
forceirule_9 = ConstructForceIndeterminaciesRule(ForceIndeterminaciesRuleID=force_indeterminacies_rule_9, Forces=genes_9)
policy_9 = ConstructTransformationPolicy(
    EntropyRate=entropy_rate_9,
    ForceSelectionRuleForcesSet=constructforceset_8.ForceSet,
    NodePlacementRulePoint=nodeprule_9,
    ForceIndeterminaciesRuleAxialForces=forceirule_9)
transform_8 = ApplyTransformationPolicy(Iterations=Slider(1, range=1..10), Model=transform_7, Policy=policy_9, fa=True)

force_indeterminacies_rule_10 = ValueList({"Random": 0, "UserDefinedMagnitude": 1}, selected="UserDefinedMagnitude")
node_placement_rule_10 = ValueList({"Random": 0, "UserSelectedParam": 1, "UserSelectedPt": 2, "ClosestPossible": 3, "FurthestPossible": 4, "NoNode": 5}, selected="UserSelectedParam")
topological_configuration_10 = ValueList({"Inbetween": 0, "Peripheral": 1}, selected="Inbetween")
selectforce_17 = SelectForce(Model=transform_8, Identifier=Slider(1, range=0..1))  # -> ForceObject, ForceName, AnchorPoint, ForceDirection, ForceMagnitude
selectforce_18 = SelectForce(Model=transform_8, Identifier=Slider(0.631, range=0..1))  # -> ForceObject, ForceName, AnchorPoint, ForceDirection, ForceMagnitude
genes_10 = GenePool(Decimals=2, Maximum=20, Minimum=-20, Value=[4.34, 1.49])
entropy_rate_10 = ValueList({"Convergence": -1, "Stagnation": 0, "Divergence": 1}, selected="Convergence")
constructforceset_9 = ConstructForceSet(
    EntropyRate=entropy_rate_10,
    TopologicalConfiguration=topological_configuration_10,
    Model=transform_8,
    ForceObjectS=[selectforce_17.ForceObject, selectforce_18.ForceObject])  # -> IsValid, ForceSet, EntropyRateDomain, ConstructabilityDomain, ConstrainedDomain
nodeprule_10 = ConstructNodePlacementRule(NodePlacementRuleID=node_placement_rule_10, MinDistanceToModel=Slider(0.25, range=0..1), TParam=Slider(0.68, range=0..1))
forceirule_10 = ConstructForceIndeterminaciesRule(ForceIndeterminaciesRuleID=force_indeterminacies_rule_10, Forces=genes_10)
policy_10 = ConstructTransformationPolicy(
    EntropyRate=entropy_rate_10,
    ForceSelectionRuleForcesSet=constructforceset_9.ForceSet,
    NodePlacementRulePoint=nodeprule_10,
    ForceIndeterminaciesRuleAxialForces=forceirule_10)
transform_9 = ApplyTransformationPolicy(Iterations=Slider(1, range=1..10), Model=transform_8, Policy=policy_10, fa=True)

force_indeterminacies_rule_11 = ValueList({"Random": 0, "UserDefinedMagnitude": 1}, selected="UserDefinedMagnitude")
node_placement_rule_11 = ValueList({"Random": 0, "UserSelectedParam": 1, "UserSelectedPt": 2, "ClosestPossible": 3, "FurthestPossible": 4, "NoNode": 5}, selected="UserSelectedParam")
topological_configuration_11 = ValueList({"Inbetween": 0, "Peripheral": 1}, selected="Inbetween")
selectforce_19 = SelectForce(Model=transform_9, Identifier=Slider(1, range=0..1))  # -> ForceObject, ForceName, AnchorPoint, ForceDirection, ForceMagnitude
selectforce_20 = SelectForce(Model=transform_9, Identifier=Slider(0.109, range=0..1))  # -> ForceObject, ForceName, AnchorPoint, ForceDirection, ForceMagnitude
genes_11 = GenePool(Decimals=2, Maximum=20, Minimum=-20, Value=[-5.68, 0.07])
entropy_rate_11 = ValueList({"Convergence": -1, "Stagnation": 0, "Divergence": 1}, selected="Stagnation")
constructforceset_10 = ConstructForceSet(
    EntropyRate=entropy_rate_11,
    TopologicalConfiguration=topological_configuration_11,
    Model=transform_9,
    ForceObjectS=[selectforce_19.ForceObject, selectforce_20.ForceObject])  # -> IsValid, ForceSet, EntropyRateDomain, ConstructabilityDomain, ConstrainedDomain
nodeprule_11 = ConstructNodePlacementRule(
    NodePlacementRuleID=node_placement_rule_11,
    MinDistanceToModel=Slider(0.25, range=0..1),
    TParam=Slider(0.696, range=0..1))
forceirule_11 = ConstructForceIndeterminaciesRule(ForceIndeterminaciesRuleID=force_indeterminacies_rule_11, Forces=genes_11)
policy_11 = ConstructTransformationPolicy(
    EntropyRate=entropy_rate_11,
    ForceSelectionRuleForcesSet=constructforceset_10.ForceSet,
    NodePlacementRulePoint=nodeprule_11,
    ForceIndeterminaciesRuleAxialForces=forceirule_11)
transform_10 = ApplyTransformationPolicy(Iterations=Slider(1, range=1..10), Model=transform_9, Policy=policy_11, fa=True)

force_indeterminacies_rule_12 = ValueList({"Random": 0, "UserDefinedMagnitude": 1}, selected="UserDefinedMagnitude")
node_placement_rule_12 = ValueList({"Random": 0, "UserSelectedParam": 1, "UserSelectedPt": 2, "ClosestPossible": 3, "FurthestPossible": 4, "NoNode": 5}, selected="UserSelectedParam")
topological_configuration_12 = ValueList({"Inbetween": 0, "Peripheral": 1}, selected="Inbetween")
selectforce_21 = SelectForce(Model=transform_10, Identifier=Slider(0.77, range=0..1))  # -> ForceObject, ForceName, AnchorPoint, ForceDirection, ForceMagnitude
selectforce_22 = SelectForce(Model=transform_10, Identifier=Slider(0.267, range=0..1))  # -> ForceObject, ForceName, AnchorPoint, ForceDirection, ForceMagnitude
genes_12 = GenePool(Decimals=2, Maximum=20, Minimum=-20, Value=[3.58, 0.22])
entropy_rate_12 = ValueList({"Convergence": -1, "Stagnation": 0, "Divergence": 1}, selected="Stagnation")
constructforceset_11 = ConstructForceSet(
    EntropyRate=entropy_rate_12,
    TopologicalConfiguration=topological_configuration_12,
    Model=transform_10,
    ForceObjectS=[selectforce_21.ForceObject, selectforce_22.ForceObject])  # -> IsValid, ForceSet, EntropyRateDomain, ConstructabilityDomain, ConstrainedDomain
nodeprule_12 = ConstructNodePlacementRule(
    NodePlacementRuleID=node_placement_rule_12,
    MinDistanceToModel=Slider(0.25, range=0..1),
    TParam=Slider(0.434, range=0..1))
forceirule_12 = ConstructForceIndeterminaciesRule(ForceIndeterminaciesRuleID=force_indeterminacies_rule_12, Forces=genes_12)
policy_12 = ConstructTransformationPolicy(
    EntropyRate=entropy_rate_12,
    ForceSelectionRuleForcesSet=constructforceset_11.ForceSet,
    NodePlacementRulePoint=nodeprule_12,
    ForceIndeterminaciesRuleAxialForces=forceirule_12)
transform_11 = ApplyTransformationPolicy(Iterations=Slider(1, range=1..10), Model=transform_10, Policy=policy_12, fa=True)

force_indeterminacies_rule_13 = ValueList({"Random": 0, "UserDefinedMagnitude": 1}, selected="UserDefinedMagnitude")
node_placement_rule_13 = ValueList({"Random": 0, "UserSelectedParam": 1, "UserSelectedPt": 2, "ClosestPossible": 3, "FurthestPossible": 4, "NoNode": 5}, selected="UserSelectedParam")
topological_configuration_13 = ValueList({"Inbetween": 0, "Peripheral": 1}, selected="Inbetween")
selectforce_23 = SelectForce(Model=transform_11, Identifier=Slider(0.77, range=0..1))  # -> ForceObject, ForceName, AnchorPoint, ForceDirection, ForceMagnitude
selectforce_24 = SelectForce(Model=transform_11, Identifier=Slider(0.936, range=0..1))  # -> ForceObject, ForceName, AnchorPoint, ForceDirection, ForceMagnitude
genes_13 = GenePool(Decimals=2, Maximum=20, Minimum=-20, Value=[3.58, 0.22])
entropy_rate_13 = ValueList({"Convergence": -1, "Stagnation": 0, "Divergence": 1}, selected="Convergence")
constructforceset_12 = ConstructForceSet(
    EntropyRate=entropy_rate_13,
    TopologicalConfiguration=topological_configuration_13,
    Model=transform_11,
    ForceObjectS=[selectforce_23.ForceObject, selectforce_24.ForceObject])  # -> IsValid, ForceSet, EntropyRateDomain, ConstructabilityDomain, ConstrainedDomain
nodeprule_13 = ConstructNodePlacementRule(
    NodePlacementRuleID=node_placement_rule_13,
    MinDistanceToModel=Slider(0.25, range=0..1),
    TParam=Slider(0.434, range=0..1))
forceirule_13 = ConstructForceIndeterminaciesRule(ForceIndeterminaciesRuleID=force_indeterminacies_rule_13, Forces=genes_13)
policy_13 = ConstructTransformationPolicy(
    EntropyRate=entropy_rate_13,
    ForceSelectionRuleForcesSet=constructforceset_12.ForceSet,
    NodePlacementRulePoint=nodeprule_13,
    ForceIndeterminaciesRuleAxialForces=forceirule_13)
transform_12 = ApplyTransformationPolicy(Iterations=Slider(1, range=1..10), Model=transform_11, Policy=policy_13, fa=True)

force_indeterminacies_rule_14 = ValueList({"Random": 0, "UserDefinedMagnitude": 1}, selected="UserDefinedMagnitude")
node_placement_rule_14 = ValueList({"Random": 0, "UserSelectedParam": 1, "UserSelectedPt": 2, "ClosestPossible": 3, "FurthestPossible": 4, "NoNode": 5}, selected="UserSelectedParam")
topological_configuration_14 = ValueList({"Inbetween": 0, "Peripheral": 1}, selected="Inbetween")
selectforce_25 = SelectForce(Model=transform_12, Identifier=Slider(0.77, range=0..1))  # -> ForceObject, ForceName, AnchorPoint, ForceDirection, ForceMagnitude
selectforce_26 = SelectForce(Model=transform_12, Identifier=Slider(0.129, range=0..1))  # -> ForceObject, ForceName, AnchorPoint, ForceDirection, ForceMagnitude
genes_14 = GenePool(Decimals=2, Maximum=20, Minimum=-20, Value=[3.58, 0.22])
entropy_rate_14 = ValueList({"Convergence": -1, "Stagnation": 0, "Divergence": 1}, selected="Convergence")
constructforceset_13 = ConstructForceSet(
    EntropyRate=entropy_rate_14,
    TopologicalConfiguration=topological_configuration_14,
    Model=transform_12,
    ForceObjectS=[selectforce_25.ForceObject, selectforce_26.ForceObject])  # -> IsValid, ForceSet, EntropyRateDomain, ConstructabilityDomain, ConstrainedDomain
nodeprule_14 = ConstructNodePlacementRule(
    NodePlacementRuleID=node_placement_rule_14,
    MinDistanceToModel=Slider(0.25, range=0..1),
    TParam=Slider(0.434, range=0..1))
forceirule_14 = ConstructForceIndeterminaciesRule(ForceIndeterminaciesRuleID=force_indeterminacies_rule_14, Forces=genes_14)
policy_14 = ConstructTransformationPolicy(
    EntropyRate=entropy_rate_14,
    ForceSelectionRuleForcesSet=constructforceset_13.ForceSet,
    NodePlacementRulePoint=nodeprule_14,
    ForceIndeterminaciesRuleAxialForces=forceirule_14)
transform_13 = ApplyTransformationPolicy(Iterations=Slider(1, range=1..10), Model=transform_12, Policy=policy_14, fa=True)

transform_14 = ApplyTransformationPolicy(Iterations=Slider(1, range=1..10), Model=transform_13, Policy=policy_5, fa=True)

pt_19 = Point(<point referenced from the Rhino model>)
yz = YZPlane(Origin=pt_19)
modelgeometry = ModelGeometry(Model=transform_14, MirrorPlane=yz, NodalRadius=Slider(0.25, range=0..3), ForceScale=Slider(1, range=0..3))  # -> Nodes, ForcesExt, ForcesInt, BarsCompression, BarsTension
