# Grasshopper definition arch_bridge_transformation[completed].gh (Grasshopper 1.0.7)
# plug-ins: Libra

crv = Curve(<curve referenced from the Rhino model>)
constructdomain = ConstructDomain(RegionsIn=crv)

pt = Point(<point referenced from the Rhino model>)
pt_2 = Point(<point referenced from the Rhino model>)
pt_3 = Point(<point referenced from the Rhino model>)
pt_4 = Point(<point referenced from the Rhino model>)
pt_5 = Point(<point referenced from the Rhino model>)
pt_6 = Point(<point referenced from the Rhino model>)
pt_7 = Point(<point referenced from the Rhino model>)
pt_8 = Point(<point referenced from the Rhino model>)
pt_9 = Point(<point referenced from the Rhino model>)
pt_10 = Point(<point referenced from the Rhino model>)
pt_11 = Point(<point referenced from the Rhino model>)
pt_12 = Point(<point referenced from the Rhino model>)
vec2pt = Vector2Pt(PointA=pt, PointB=pt_2, Unitize=False)  # -> Vector, Length
vec2pt_2 = Vector2Pt(PointA=pt_3, PointB=pt_4, Unitize=False)  # -> Vector, Length
vec2pt_3 = Vector2Pt(PointA=pt_5, PointB=pt_6, Unitize=False)  # -> Vector, Length
vec2pt_4 = Vector2Pt(PointA=pt_7, PointB=pt_8, Unitize=False)  # -> Vector, Length
vec2pt_5 = Vector2Pt(PointA=pt_9, PointB=pt_10, Unitize=False)  # -> Vector, Length
vec2pt_6 = Vector2Pt(PointA=pt_11, PointB=pt_12, Unitize=False)  # -> Vector, Length
merge = Merge(Data1=pt_2, Data2=pt_4, Data3=pt_6, Data4=pt_8, Data5=pt_10, Data6=pt_12)
merge_2 = Merge(
    Data1=vec2pt.Vector,
    Data2=vec2pt_2.Vector,
    Data3=vec2pt_3.Vector,
    Data4=vec2pt_4.Vector,
    Data5=vec2pt_5.Vector,
    Data6=vec2pt_6.Vector)
constructmodel = ConstructModel(AnchorPoint=merge, ForceVector=merge_2, DesignDomain=constructdomain)

# ---- group: Transformation Policy Parameters
force_indeterminacies_rule = ValueList({"Random": 0, "UserDefinedMagnitude": 1}, selected="UserDefinedMagnitude")
node_placement_rule = ValueList({"Random": 0, "UserSelectedParam": 1, "UserSelectedPt": 2, "ClosestPossible": 3, "FurthestPossible": 4, "NoNode": 5}, selected="UserSelectedParam")
topological_configuration = ValueList({"Inbetween": 0, "Peripheral": 1}, selected="Inbetween")
genes = GenePool(
    Decimals=0,
    Maximum=12,
    Minimum=2,
    Value=[4.130162197, 9.549842248, 4.875048158, 10.79694378, 7.990194196, 9.276587899, 4.529141641, 10.48651755, 10.97979528, 7.666553818])
genes_2 = GenePool(
    Decimals=0,
    Maximum=1,
    Minimum=0,
    Value=[0.5433814226, 0.6272061112, 0.8790792147, 0.1124051534, 0.9352134238, 0.1000089714, 0.2706218356, 0.3054573491, 0.7149484384, 0.534999741])
genes_3 = GenePool(
    Decimals=3,
    Maximum=1,
    Minimum=0,
    Value=[0.5126746675, 0.07333598618, 0.3303806907, 0.2610297233, 0.7261922813, 0.5745299818, 0.07019557647, 0.966721839, 0.7993485888, 0.7191134355])
type_of_force_set = ValueList({"Monomial": 0, "Binomial": 1}, selected="Binomial")
genes_4 = GenePool(
    Decimals=2,
    Maximum=10,
    Minimum=-10,
    Value=[-1.65085474, -6.639235847, 9.847829226, -4.694023249, -0.05631046361, 8.496785202, -4.791705314, -5.254526023, -2.881335442, 8.529352096, -0.04585148734, 4.032925858, -9.785404706, 0.7990707009, -1.642144715, 6.576045969, -6.483453758, -7.716797274, 0.03351815277, 6.88428059])
forcesrule = ConstructForceSelectionRule(
    ForceSelectionRuleID=genes,
    TypeOfForceSet=type_of_force_set,
    TopologicalConfiguration=topological_configuration,
    FlipForcesOrder=genes_2)
nodeprule = ConstructNodePlacementRule(NodePlacementRuleID=node_placement_rule, MinDistanceToModel=Slider(0.25, range=0..1), TParam=genes_3)
forceirule = ConstructForceIndeterminaciesRule(ForceIndeterminaciesRuleID=force_indeterminacies_rule, Forces=genes_4)
entropy_rate = ValueList({"Convergence": -1, "Stagnation": 0, "Divergence": 1}, selected="Convergence")
policy = ConstructTransformationPolicy(
    EntropyRate=entropy_rate,
    ForceSelectionRuleForcesSet=forcesrule,
    NodePlacementRulePoint=nodeprule,
    ForceIndeterminaciesRuleAxialForces=forceirule)

# ----
transform = ApplyTransformationPolicy(Iterations=Slider(10, range=1..10), Model=constructmodel, Policy=policy, fa=True)
