# Grasshopper definition simple_pylon [completed].gh (Grasshopper 1.0.8)
# plug-ins: LibraGH

# ----
# construct domain
crv = Curve(<curve referenced from the Rhino model>)
constructdomain = ConstructDomain(RegionsIn=crv)

# ----
# construct model
pt = Point(<point referenced from the Rhino model>)
pt_2 = Point(<point referenced from the Rhino model>)
pt_3 = Point(<point referenced from the Rhino model>)
pt_4 = Point(<point referenced from the Rhino model>)
pt_5 = Point(<point referenced from the Rhino model>)
pt_6 = Point(<point referenced from the Rhino model>)
pt_7 = Point(<point referenced from the Rhino model>)
pt_8 = Point(<point referenced from the Rhino model>)
pt_9 = Point(<point referenced from the Rhino model>)
pt_10 = Point(<point referenced from the Rhino model>)
vec2pt = Vector2Pt(PointA=pt, PointB=pt_2, Unitize=False)  # -> Vector, Length
vec2pt_2 = Vector2Pt(PointA=pt_3, PointB=pt_4, Unitize=False)  # -> Vector, Length
vec2pt_3 = Vector2Pt(PointA=pt_5, PointB=pt_6, Unitize=False)  # -> Vector, Length
vec2pt_4 = Vector2Pt(PointA=pt_7, PointB=pt_8, Unitize=False)  # -> Vector, Length
vec2pt_5 = Vector2Pt(PointA=pt_9, PointB=pt_10, Unitize=False)  # -> Vector, Length
merge = Merge(Data1=pt_2, Data2=pt_4, Data3=pt_6, Data4=pt_8, Data5=pt_10)
merge_2 = Merge(Data1=vec2pt.Vector, Data2=vec2pt_2.Vector, Data3=vec2pt_3.Vector, Data4=vec2pt_4.Vector, Data5=vec2pt_5.Vector)
constructmodel = ConstructModel(AnchorPoint=merge, ForceVector=merge_2, DesignDomain=constructdomain)

# ----
# different forceset rule
force_s_selection_rule = ValueList({"Random": 0, "ProximityToUserSelectedPoint": 1, "MinMagnitude": 2, "MaxMagnitude": 3, "Oldest": 4, "Newest": 5, "Oldest_Newest_Bi": 6, "Closest": 7, "Furthest": 8, "ClosestToDomainCentroid": 9, "FurthestToDomainCentroid": 10, "ClosestToPtCloud": 11, "FurthestToPtCloud": 12, "IndexExplicit": 13, "ManuallyExplicit": 14}, selected="Oldest_Newest_Bi")

# ----
# global bar length constraints
transformation_constraint = ValueList({"BarLengths": 0, "EqualBarLengths": 1, "PredefinedBars": 2}, selected="BarLengths")
constraint = ConstructTransformationConstraint(
    TransformationConstraintID=transformation_constraint,
    MinimumLength=Slider(2, range=0..10),
    MaximumLength=Slider(10, range=0..10))

# ----
# implicit forceset selection
# define policy
genes = GenePool(Decimals=2, Maximum=1, Minimum=-1, Value=[0.66, 1])
force_s_selection_rule_2 = ValueList({"Random": 0, "ProximityToUserSelectedPoint": 1, "MinMagnitude": 2, "MaxMagnitude": 3, "Oldest": 4, "Newest": 5, "Oldest_Newest_Bi": 6, "Closest": 7, "Furthest": 8, "ClosestToDomainCentroid": 9, "FurthestToDomainCentroid": 10, "ClosestToPtCloud": 11, "FurthestToPtCloud": 12, "IndexExplicit": 13, "ManuallyExplicit": 14}, selected="Newest")
force_indeterminacies_rule = ValueList({"Random": 0, "UserDefinedMagnitude": 1}, selected="UserDefinedMagnitude")
node_placement_rule = ValueList({"Random": 0, "UserSelectedParam": 1, "UserSelectedPt": 2, "ClosestPossible": 3, "FurthestPossible": 4, "NoNode": 5}, selected="UserSelectedParam")
topological_configuration = ValueList({"Inbetween": 0, "Peripheral": 1}, selected="Inbetween")
type_of_force_set = ValueList({"Monomial": 0, "Binomial": 1}, selected="Binomial")
multiplication = Multiplication(A=genes, B=Slider(5, range=0..10))
forcesrule = ConstructForceSelectionRule(
    ForceSelectionRuleID=force_s_selection_rule_2,
    TypeOfForceSet=type_of_force_set,
    TopologicalConfiguration=topological_configuration,
    FlipForcesOrder=Toggle(False))
nodeprule = ConstructNodePlacementRule(NodePlacementRuleID=node_placement_rule, MinDistanceToModel=Slider(0.25, range=0..1), TParam=Slider(0.714, range=0..1))
forceirule = ConstructForceIndeterminaciesRule(ForceIndeterminaciesRuleID=force_indeterminacies_rule, Forces=multiplication)
entropy_rate = ValueList({"Convergence": -1, "Stagnation": 0, "Divergence": 1}, selected="Convergence")
policy = ConstructTransformationPolicy(
    EntropyRate=entropy_rate,
    ForceSelectionRuleForcesSet=forcesrule,
    NodePlacementRulePoint=nodeprule,
    ForceIndeterminaciesRuleAxialForces=forceirule,
    TransformationConstraints=constraint)

# ----
# implicit forceset selection
# define policy
genes_2 = GenePool(Decimals=2, Maximum=1, Minimum=-1, Value=[0.41, 1])
force_s_selection_rule_3 = ValueList({"Random": 0, "ProximityToUserSelectedPoint": 1, "MinMagnitude": 2, "MaxMagnitude": 3, "Oldest": 4, "Newest": 5, "Oldest_Newest_Bi": 6, "Closest": 7, "Furthest": 8, "ClosestToDomainCentroid": 9, "FurthestToDomainCentroid": 10, "ClosestToPtCloud": 11, "FurthestToPtCloud": 12, "IndexExplicit": 13, "ManuallyExplicit": 14}, selected="Newest")
force_indeterminacies_rule_2 = ValueList({"Random": 0, "UserDefinedMagnitude": 1}, selected="UserDefinedMagnitude")
node_placement_rule_2 = ValueList({"Random": 0, "UserSelectedParam": 1, "UserSelectedPt": 2, "ClosestPossible": 3, "FurthestPossible": 4, "NoNode": 5}, selected="UserSelectedParam")
topological_configuration_2 = ValueList({"Inbetween": 0, "Peripheral": 1}, selected="Inbetween")
type_of_force_set_2 = ValueList({"Monomial": 0, "Binomial": 1}, selected="Binomial")
multiplication_2 = Multiplication(A=genes_2, B=Slider(5, range=0..10))
forcesrule_2 = ConstructForceSelectionRule(
    ForceSelectionRuleID=force_s_selection_rule_3,
    TypeOfForceSet=type_of_force_set_2,
    TopologicalConfiguration=topological_configuration_2,
    FlipForcesOrder=Toggle(False))
nodeprule_2 = ConstructNodePlacementRule(NodePlacementRuleID=node_placement_rule_2, MinDistanceToModel=Slider(0.25, range=0..1), TParam=Slider(0.634, range=0..1))
forceirule_2 = ConstructForceIndeterminaciesRule(ForceIndeterminaciesRuleID=force_indeterminacies_rule_2, Forces=multiplication_2)
entropy_rate_2 = ValueList({"Convergence": -1, "Stagnation": 0, "Divergence": 1}, selected="Convergence")
policy_2 = ConstructTransformationPolicy(
    EntropyRate=entropy_rate_2,
    ForceSelectionRuleForcesSet=forcesrule_2,
    NodePlacementRulePoint=nodeprule_2,
    ForceIndeterminaciesRuleAxialForces=forceirule_2,
    TransformationConstraints=constraint)

# ----
# implicit forceset selection
# define policy
genes_3 = GenePool(Decimals=2, Maximum=1, Minimum=-1, Value=[0.41, 1])
force_s_selection_rule_4 = ValueList({"Random": 0, "ProximityToUserSelectedPoint": 1, "MinMagnitude": 2, "MaxMagnitude": 3, "Oldest": 4, "Newest": 5, "Oldest_Newest_Bi": 6, "Closest": 7, "Furthest": 8, "ClosestToDomainCentroid": 9, "FurthestToDomainCentroid": 10, "ClosestToPtCloud": 11, "FurthestToPtCloud": 12, "IndexExplicit": 13, "ManuallyExplicit": 14}, selected="Newest")
force_indeterminacies_rule_3 = ValueList({"Random": 0, "UserDefinedMagnitude": 1}, selected="UserDefinedMagnitude")
node_placement_rule_3 = ValueList({"Random": 0, "UserSelectedParam": 1, "UserSelectedPt": 2, "ClosestPossible": 3, "FurthestPossible": 4, "NoNode": 5}, selected="UserSelectedParam")
topological_configuration_3 = ValueList({"Inbetween": 0, "Peripheral": 1}, selected="Inbetween")
type_of_force_set_3 = ValueList({"Monomial": 0, "Binomial": 1}, selected="Binomial")
multiplication_3 = Multiplication(A=genes_3, B=Slider(5, range=0..10))
forcesrule_3 = ConstructForceSelectionRule(
    ForceSelectionRuleID=force_s_selection_rule_4,
    TypeOfForceSet=type_of_force_set_3,
    TopologicalConfiguration=topological_configuration_3,
    FlipForcesOrder=Toggle(False))
nodeprule_3 = ConstructNodePlacementRule(NodePlacementRuleID=node_placement_rule_3, MinDistanceToModel=Slider(0.25, range=0..1), TParam=Slider(0.634, range=0..1))
forceirule_3 = ConstructForceIndeterminaciesRule(ForceIndeterminaciesRuleID=force_indeterminacies_rule_3, Forces=multiplication_3)
entropy_rate_3 = ValueList({"Convergence": -1, "Stagnation": 0, "Divergence": 1}, selected="Convergence")
policy_3 = ConstructTransformationPolicy(
    EntropyRate=entropy_rate_3,
    ForceSelectionRuleForcesSet=forcesrule_3,
    NodePlacementRulePoint=nodeprule_3,
    ForceIndeterminaciesRuleAxialForces=forceirule_3,
    TransformationConstraints=constraint)

# ----
# implicit forceset selection
# define policy
genes_4 = GenePool(Decimals=2, Maximum=1, Minimum=-1, Value=[-1, 0.9757317491])
force_indeterminacies_rule_4 = ValueList({"Random": 0, "UserDefinedMagnitude": 1}, selected="UserDefinedMagnitude")
node_placement_rule_4 = ValueList({"Random": 0, "UserSelectedParam": 1, "UserSelectedPt": 2, "ClosestPossible": 3, "FurthestPossible": 4, "NoNode": 5}, selected="UserSelectedParam")
topological_configuration_4 = ValueList({"Inbetween": 0, "Peripheral": 1}, selected="Inbetween")
type_of_force_set_4 = ValueList({"Monomial": 0, "Binomial": 1}, selected="Binomial")
multiplication_4 = Multiplication(A=genes_4, B=Slider(5, range=0..10))
forcesrule_4 = ConstructForceSelectionRule(
    ForceSelectionRuleID=force_s_selection_rule,
    TypeOfForceSet=type_of_force_set_4,
    TopologicalConfiguration=topological_configuration_4,
    FlipForcesOrder=Toggle(False))
nodeprule_4 = ConstructNodePlacementRule(NodePlacementRuleID=node_placement_rule_4, MinDistanceToModel=Slider(0.25, range=0..1), TParam=Slider(0.63, range=0..1))
forceirule_4 = ConstructForceIndeterminaciesRule(ForceIndeterminaciesRuleID=force_indeterminacies_rule_4, Forces=multiplication_4)
entropy_rate_4 = ValueList({"Convergence": -1, "Stagnation": 0, "Divergence": 1}, selected="Convergence")
policy_4 = ConstructTransformationPolicy(
    EntropyRate=entropy_rate_4,
    ForceSelectionRuleForcesSet=forcesrule_4,
    NodePlacementRulePoint=nodeprule_4,
    ForceIndeterminaciesRuleAxialForces=forceirule_4,
    TransformationConstraints=constraint)

# ----
# implicit forceset selection
# define policy
genes_5 = GenePool(Decimals=2, Maximum=1, Minimum=-1, Value=[0.75, 1])
force_s_selection_rule_5 = ValueList({"Random": 0, "ProximityToUserSelectedPoint": 1, "MinMagnitude": 2, "MaxMagnitude": 3, "Oldest": 4, "Newest": 5, "Oldest_Newest_Bi": 6, "Closest": 7, "Furthest": 8, "ClosestToDomainCentroid": 9, "FurthestToDomainCentroid": 10, "ClosestToPtCloud": 11, "FurthestToPtCloud": 12, "IndexExplicit": 13, "ManuallyExplicit": 14}, selected="Newest")
force_indeterminacies_rule_5 = ValueList({"Random": 0, "UserDefinedMagnitude": 1}, selected="UserDefinedMagnitude")
node_placement_rule_5 = ValueList({"Random": 0, "UserSelectedParam": 1, "UserSelectedPt": 2, "ClosestPossible": 3, "FurthestPossible": 4, "NoNode": 5}, selected="UserSelectedParam")
topological_configuration_5 = ValueList({"Inbetween": 0, "Peripheral": 1}, selected="Inbetween")
type_of_force_set_5 = ValueList({"Monomial": 0, "Binomial": 1}, selected="Binomial")
multiplication_5 = Multiplication(A=genes_5, B=Slider(5, range=0..10))
forcesrule_5 = ConstructForceSelectionRule(
    ForceSelectionRuleID=force_s_selection_rule_5,
    TypeOfForceSet=type_of_force_set_5,
    TopologicalConfiguration=topological_configuration_5,
    FlipForcesOrder=Toggle(False))
nodeprule_5 = ConstructNodePlacementRule(NodePlacementRuleID=node_placement_rule_5, MinDistanceToModel=Slider(0.25, range=0..1), TParam=Slider(0.39, range=0..1))
forceirule_5 = ConstructForceIndeterminaciesRule(ForceIndeterminaciesRuleID=force_indeterminacies_rule_5, Forces=multiplication_5)
entropy_rate_5 = ValueList({"Convergence": -1, "Stagnation": 0, "Divergence": 1}, selected="Convergence")
policy_5 = ConstructTransformationPolicy(
    EntropyRate=entropy_rate_5,
    ForceSelectionRuleForcesSet=forcesrule_5,
    NodePlacementRulePoint=nodeprule_5,
    ForceIndeterminaciesRuleAxialForces=forceirule_5,
    TransformationConstraints=constraint)

# ----
# implicit forceset selection
# define policy
genes_6 = GenePool(Decimals=2, Maximum=1, Minimum=-1, Value=[-1, 0.9757317491])
force_s_selection_rule_6 = ValueList({"Random": 0, "ProximityToUserSelectedPoint": 1, "MinMagnitude": 2, "MaxMagnitude": 3, "Oldest": 4, "Newest": 5, "Oldest_Newest_Bi": 6, "Closest": 7, "Furthest": 8, "ClosestToDomainCentroid": 9, "FurthestToDomainCentroid": 10, "ClosestToPtCloud": 11, "FurthestToPtCloud": 12, "IndexExplicit": 13, "ManuallyExplicit": 14}, selected="Newest")
force_indeterminacies_rule_6 = ValueList({"Random": 0, "UserDefinedMagnitude": 1}, selected="UserDefinedMagnitude")
node_placement_rule_6 = ValueList({"Random": 0, "UserSelectedParam": 1, "UserSelectedPt": 2, "ClosestPossible": 3, "FurthestPossible": 4, "NoNode": 5}, selected="UserSelectedParam")
topological_configuration_6 = ValueList({"Inbetween": 0, "Peripheral": 1}, selected="Inbetween")
type_of_force_set_6 = ValueList({"Monomial": 0, "Binomial": 1}, selected="Binomial")
multiplication_6 = Multiplication(A=genes_6, B=Slider(5, range=0..10))
forcesrule_6 = ConstructForceSelectionRule(
    ForceSelectionRuleID=force_s_selection_rule_6,
    TypeOfForceSet=type_of_force_set_6,
    TopologicalConfiguration=topological_configuration_6,
    FlipForcesOrder=Toggle(False))
nodeprule_6 = ConstructNodePlacementRule(NodePlacementRuleID=node_placement_rule_6, MinDistanceToModel=Slider(0.25, range=0..1), TParam=Slider(0.63, range=0..1))
forceirule_6 = ConstructForceIndeterminaciesRule(ForceIndeterminaciesRuleID=force_indeterminacies_rule_6, Forces=multiplication_6)
entropy_rate_6 = ValueList({"Convergence": -1, "Stagnation": 0, "Divergence": 1}, selected="Convergence")
policy_6 = ConstructTransformationPolicy(
    EntropyRate=entropy_rate_6,
    ForceSelectionRuleForcesSet=forcesrule_6,
    NodePlacementRulePoint=nodeprule_6,
    ForceIndeterminaciesRuleAxialForces=forceirule_6,
    TransformationConstraints=constraint)

# ----
# implicit forceset selection
# define policy
genes_7 = GenePool(Decimals=2, Maximum=1, Minimum=-1, Value=[-1, 0.9757317491])
force_s_selection_rule_7 = ValueList({"Random": 0, "ProximityToUserSelectedPoint": 1, "MinMagnitude": 2, "MaxMagnitude": 3, "Oldest": 4, "Newest": 5, "Oldest_Newest_Bi": 6, "Closest": 7, "Furthest": 8, "ClosestToDomainCentroid": 9, "FurthestToDomainCentroid": 10, "ClosestToPtCloud": 11, "FurthestToPtCloud": 12, "IndexExplicit": 13, "ManuallyExplicit": 14}, selected="Newest")
force_indeterminacies_rule_7 = ValueList({"Random": 0, "UserDefinedMagnitude": 1}, selected="UserDefinedMagnitude")
node_placement_rule_7 = ValueList({"Random": 0, "UserSelectedParam": 1, "UserSelectedPt": 2, "ClosestPossible": 3, "FurthestPossible": 4, "NoNode": 5}, selected="UserSelectedParam")
topological_configuration_7 = ValueList({"Inbetween": 0, "Peripheral": 1}, selected="Inbetween")
type_of_force_set_7 = ValueList({"Monomial": 0, "Binomial": 1}, selected="Binomial")
multiplication_7 = Multiplication(A=genes_7, B=Slider(5, range=0..10))
forcesrule_7 = ConstructForceSelectionRule(
    ForceSelectionRuleID=force_s_selection_rule_7,
    TypeOfForceSet=type_of_force_set_7,
    TopologicalConfiguration=topological_configuration_7,
    FlipForcesOrder=Toggle(False))
nodeprule_7 = ConstructNodePlacementRule(NodePlacementRuleID=node_placement_rule_7, MinDistanceToModel=Slider(0.25, range=0..1), TParam=Slider(0.63, range=0..1))
forceirule_7 = ConstructForceIndeterminaciesRule(ForceIndeterminaciesRuleID=force_indeterminacies_rule_7, Forces=multiplication_7)
entropy_rate_7 = ValueList({"Convergence": -1, "Stagnation": 0, "Divergence": 1}, selected="Convergence")
policy_7 = ConstructTransformationPolicy(
    EntropyRate=entropy_rate_7,
    ForceSelectionRuleForcesSet=forcesrule_7,
    NodePlacementRulePoint=nodeprule_7,
    ForceIndeterminaciesRuleAxialForces=forceirule_7,
    TransformationConstraints=constraint)

# ----
# implicit forceset selection
# define policy
genes_8 = GenePool(Decimals=2, Maximum=1, Minimum=-1, Value=[-0.34, 0.9757317491])
force_s_selection_rule_8 = ValueList({"Random": 0, "ProximityToUserSelectedPoint": 1, "MinMagnitude": 2, "MaxMagnitude": 3, "Oldest": 4, "Newest": 5, "Oldest_Newest_Bi": 6, "Closest": 7, "Furthest": 8, "ClosestToDomainCentroid": 9, "FurthestToDomainCentroid": 10, "ClosestToPtCloud": 11, "FurthestToPtCloud": 12, "IndexExplicit": 13, "ManuallyExplicit": 14}, selected="Oldest")
force_indeterminacies_rule_8 = ValueList({"Random": 0, "UserDefinedMagnitude": 1}, selected="UserDefinedMagnitude")
node_placement_rule_8 = ValueList({"Random": 0, "UserSelectedParam": 1, "UserSelectedPt": 2, "ClosestPossible": 3, "FurthestPossible": 4, "NoNode": 5}, selected="UserSelectedParam")
topological_configuration_8 = ValueList({"Inbetween": 0, "Peripheral": 1}, selected="Inbetween")
type_of_force_set_8 = ValueList({"Monomial": 0, "Binomial": 1}, selected="Binomial")
multiplication_8 = Multiplication(A=genes_8, B=Slider(5, range=0..10))
forcesrule_8 = ConstructForceSelectionRule(
    ForceSelectionRuleID=force_s_selection_rule_8,
    TypeOfForceSet=type_of_force_set_8,
    TopologicalConfiguration=topological_configuration_8,
    FlipForcesOrder=Toggle(False))
nodeprule_8 = ConstructNodePlacementRule(NodePlacementRuleID=node_placement_rule_8, MinDistanceToModel=Slider(0.25, range=0..1), TParam=Slider(0.192, range=0..1))
forceirule_8 = ConstructForceIndeterminaciesRule(ForceIndeterminaciesRuleID=force_indeterminacies_rule_8, Forces=multiplication_8)
entropy_rate_8 = ValueList({"Convergence": -1, "Stagnation": 0, "Divergence": 1}, selected="Convergence")
policy_8 = ConstructTransformationPolicy(
    EntropyRate=entropy_rate_8,
    ForceSelectionRuleForcesSet=forcesrule_8,
    NodePlacementRulePoint=nodeprule_8,
    ForceIndeterminaciesRuleAxialForces=forceirule_8,
    TransformationConstraints=constraint)

# ----
# implicit forceset selection
# define policy
genes_9 = GenePool(Decimals=2, Maximum=1, Minimum=-1, Value=[-0.55, -0.28])
force_s_selection_rule_9 = ValueList({"Random": 0, "ProximityToUserSelectedPoint": 1, "MinMagnitude": 2, "MaxMagnitude": 3, "Oldest": 4, "Newest": 5, "Oldest_Newest_Bi": 6, "Closest": 7, "Furthest": 8, "ClosestToDomainCentroid": 9, "FurthestToDomainCentroid": 10, "ClosestToPtCloud": 11, "FurthestToPtCloud": 12, "IndexExplicit": 13, "ManuallyExplicit": 14}, selected="Newest")
force_indeterminacies_rule_9 = ValueList({"Random": 0, "UserDefinedMagnitude": 1}, selected="UserDefinedMagnitude")
node_placement_rule_9 = ValueList({"Random": 0, "UserSelectedParam": 1, "UserSelectedPt": 2, "ClosestPossible": 3, "FurthestPossible": 4, "NoNode": 5}, selected="UserSelectedParam")
topological_configuration_9 = ValueList({"Inbetween": 0, "Peripheral": 1}, selected="Inbetween")
type_of_force_set_9 = ValueList({"Monomial": 0, "Binomial": 1}, selected="Binomial")
multiplication_9 = Multiplication(A=genes_9, B=Slider(5, range=0..10))
forcesrule_9 = ConstructForceSelectionRule(
    ForceSelectionRuleID=force_s_selection_rule_9,
    TypeOfForceSet=type_of_force_set_9,
    TopologicalConfiguration=topological_configuration_9,
    FlipForcesOrder=Toggle(True))
nodeprule_9 = ConstructNodePlacementRule(NodePlacementRuleID=node_placement_rule_9, MinDistanceToModel=Slider(0.25, range=0..1), TParam=Slider(0.472, range=0..1))
forceirule_9 = ConstructForceIndeterminaciesRule(ForceIndeterminaciesRuleID=force_indeterminacies_rule_9, Forces=multiplication_9)
# intentional stagnation
entropy_rate_9 = ValueList({"Convergence": -1, "Stagnation": 0, "Divergence": 1}, selected="Stagnation")
policy_9 = ConstructTransformationPolicy(
    EntropyRate=entropy_rate_9,
    ForceSelectionRuleForcesSet=forcesrule_9,
    NodePlacementRulePoint=nodeprule_9,
    ForceIndeterminaciesRuleAxialForces=forceirule_9,
    TransformationConstraints=constraint)

# ----
# implicit forceset selection
# define policy
genes_10 = GenePool(Decimals=2, Maximum=1, Minimum=-1, Value=[-0.27, -0.43])
force_s_selection_rule_10 = ValueList({"Random": 0, "ProximityToUserSelectedPoint": 1, "MinMagnitude": 2, "MaxMagnitude": 3, "Oldest": 4, "Newest": 5, "Oldest_Newest_Bi": 6, "Closest": 7, "Furthest": 8, "ClosestToDomainCentroid": 9, "FurthestToDomainCentroid": 10, "ClosestToPtCloud": 11, "FurthestToPtCloud": 12, "IndexExplicit": 13, "ManuallyExplicit": 14}, selected="Newest")
force_indeterminacies_rule_10 = ValueList({"Random": 0, "UserDefinedMagnitude": 1}, selected="UserDefinedMagnitude")
node_placement_rule_10 = ValueList({"Random": 0, "UserSelectedParam": 1, "UserSelectedPt": 2, "ClosestPossible": 3, "FurthestPossible": 4, "NoNode": 5}, selected="UserSelectedParam")
topological_configuration_10 = ValueList({"Inbetween": 0, "Peripheral": 1}, selected="Inbetween")
type_of_force_set_10 = ValueList({"Monomial": 0, "Binomial": 1}, selected="Binomial")
multiplication_10 = Multiplication(A=genes_10, B=Slider(5, range=0..10))
forcesrule_10 = ConstructForceSelectionRule(
    ForceSelectionRuleID=force_s_selection_rule_10,
    TypeOfForceSet=type_of_force_set_10,
    TopologicalConfiguration=topological_configuration_10,
    FlipForcesOrder=Toggle(True))
nodeprule_10 = ConstructNodePlacementRule(
    NodePlacementRuleID=node_placement_rule_10,
    MinDistanceToModel=Slider(0.25, range=0..1),
    TParam=Slider(0.749, range=0..1))
forceirule_10 = ConstructForceIndeterminaciesRule(ForceIndeterminaciesRuleID=force_indeterminacies_rule_10, Forces=multiplication_10)
# intentional stagnation
entropy_rate_10 = ValueList({"Convergence": -1, "Stagnation": 0, "Divergence": 1}, selected="Stagnation")
policy_10 = ConstructTransformationPolicy(
    EntropyRate=entropy_rate_10,
    ForceSelectionRuleForcesSet=forcesrule_10,
    NodePlacementRulePoint=nodeprule_10,
    ForceIndeterminaciesRuleAxialForces=forceirule_10,
    TransformationConstraints=constraint)

# ----
# implicit forceset selection
# define policy
genes_11 = GenePool(Decimals=2, Maximum=1, Minimum=-1, Value=[0.18, 0.9757317491])
force_s_selection_rule_11 = ValueList({"Random": 0, "ProximityToUserSelectedPoint": 1, "MinMagnitude": 2, "MaxMagnitude": 3, "Oldest": 4, "Newest": 5, "Oldest_Newest_Bi": 6, "Closest": 7, "Furthest": 8, "ClosestToDomainCentroid": 9, "FurthestToDomainCentroid": 10, "ClosestToPtCloud": 11, "FurthestToPtCloud": 12, "IndexExplicit": 13, "ManuallyExplicit": 14}, selected="Newest")
force_indeterminacies_rule_11 = ValueList({"Random": 0, "UserDefinedMagnitude": 1}, selected="UserDefinedMagnitude")
node_placement_rule_11 = ValueList({"Random": 0, "UserSelectedParam": 1, "UserSelectedPt": 2, "ClosestPossible": 3, "FurthestPossible": 4, "NoNode": 5}, selected="UserSelectedParam")
topological_configuration_11 = ValueList({"Inbetween": 0, "Peripheral": 1}, selected="Inbetween")
type_of_force_set_11 = ValueList({"Monomial": 0, "Binomial": 1}, selected="Binomial")
multiplication_11 = Multiplication(A=genes_11, B=Slider(5, range=0..10))
forcesrule_11 = ConstructForceSelectionRule(
    ForceSelectionRuleID=force_s_selection_rule_11,
    TypeOfForceSet=type_of_force_set_11,
    TopologicalConfiguration=topological_configuration_11,
    FlipForcesOrder=Toggle(True))
nodeprule_11 = ConstructNodePlacementRule(
    NodePlacementRuleID=node_placement_rule_11,
    MinDistanceToModel=Slider(0.25, range=0..1),
    TParam=Slider(0.407, range=0..1))
forceirule_11 = ConstructForceIndeterminaciesRule(ForceIndeterminaciesRuleID=force_indeterminacies_rule_11, Forces=multiplication_11)
# intentional stagnation
entropy_rate_11 = ValueList({"Convergence": -1, "Stagnation": 0, "Divergence": 1}, selected="Stagnation")
policy_11 = ConstructTransformationPolicy(
    EntropyRate=entropy_rate_11,
    ForceSelectionRuleForcesSet=forcesrule_11,
    NodePlacementRulePoint=nodeprule_11,
    ForceIndeterminaciesRuleAxialForces=forceirule_11,
    TransformationConstraints=constraint)

# ----
# swap forces order
toggle = BooleanToggle(True)

# ----
# implicit forceset selection
# define policy
genes_12 = GenePool(Decimals=2, Maximum=1, Minimum=-1, Value=[0.65, -0.04])
force_s_selection_rule_12 = ValueList({"Random": 0, "ProximityToUserSelectedPoint": 1, "MinMagnitude": 2, "MaxMagnitude": 3, "Oldest": 4, "Newest": 5, "Oldest_Newest_Bi": 6, "Closest": 7, "Furthest": 8, "ClosestToDomainCentroid": 9, "FurthestToDomainCentroid": 10, "ClosestToPtCloud": 11, "FurthestToPtCloud": 12, "IndexExplicit": 13, "ManuallyExplicit": 14}, selected="Newest")
force_indeterminacies_rule_12 = ValueList({"Random": 0, "UserDefinedMagnitude": 1}, selected="UserDefinedMagnitude")
node_placement_rule_12 = ValueList({"Random": 0, "UserSelectedParam": 1, "UserSelectedPt": 2, "ClosestPossible": 3, "FurthestPossible": 4, "NoNode": 5}, selected="UserSelectedParam")
topological_configuration_12 = ValueList({"Inbetween": 0, "Peripheral": 1}, selected="Inbetween")
type_of_force_set_12 = ValueList({"Monomial": 0, "Binomial": 1}, selected="Binomial")
multiplication_12 = Multiplication(A=genes_12, B=Slider(5, range=0..10))
forcesrule_12 = ConstructForceSelectionRule(
    ForceSelectionRuleID=force_s_selection_rule_12,
    TypeOfForceSet=type_of_force_set_12,
    TopologicalConfiguration=topological_configuration_12,
    FlipForcesOrder=toggle)
nodeprule_12 = ConstructNodePlacementRule(
    NodePlacementRuleID=node_placement_rule_12,
    MinDistanceToModel=Slider(0.25, range=0..1),
    TParam=Slider(0.596, range=0..1))
forceirule_12 = ConstructForceIndeterminaciesRule(ForceIndeterminaciesRuleID=force_indeterminacies_rule_12, Forces=multiplication_12)
# intentional stagnation
entropy_rate_12 = ValueList({"Convergence": -1, "Stagnation": 0, "Divergence": 1}, selected="Stagnation")
policy_12 = ConstructTransformationPolicy(
    EntropyRate=entropy_rate_12,
    ForceSelectionRuleForcesSet=forcesrule_12,
    NodePlacementRulePoint=nodeprule_12,
    ForceIndeterminaciesRuleAxialForces=forceirule_12,
    TransformationConstraints=constraint)

# ----
# manually selected point
pt_11 = Point(<point referenced from the Rhino model>)

# ----
# explicit node placement
node_placement_rule_13 = ValueList({"Random": 0, "UserSelectedParam": 1, "UserSelectedPt": 2, "ClosestPossible": 3, "FurthestPossible": 4, "NoNode": 5}, selected="UserSelectedPt")
nodeprule_13 = ConstructNodePlacementRule(NodePlacementRuleID=node_placement_rule_13, MinDistanceToModel=Slider(0.25, range=0..1), NewPoint=pt_11)

# ----
# transform model
number_slider = Slider(1, range=1..10)
# ITERATION #1
transform = ApplyTransformationPolicy(
    Iterations=number_slider,
    Model=constructmodel,
    Policy=policy_8,
    Clean_Model=False,
    Prioritize_Entropy_Rate=False,
    Prioritize_ForceSet=True,
    Show_Interim_Force_Labels=False,
    Show_Axial_Force_Labels=False,
    Show_Bar_Labels=False,
    Show_Node_Labels=True,
    fa=True)

# ----
# transform model
number_slider_2 = Slider(1, range=1..10)
# ITERATION #2
transform_2 = ApplyTransformationPolicy(
    Iterations=number_slider_2,
    Model=transform,
    Policy=policy_12,
    Clean_Model=False,
    Prioritize_Entropy_Rate=False,
    Prioritize_ForceSet=True,
    Show_Interim_Force_Labels=False,
    Show_Axial_Force_Labels=False,
    Show_Bar_Labels=False,
    Show_Node_Labels=True,
    fa=True)

# ----
# transform model
number_slider_3 = Slider(1, range=1..10)
# ITERATION #3
transform_3 = ApplyTransformationPolicy(
    Iterations=number_slider_3,
    Model=transform_2,
    Policy=policy_9,
    Clean_Model=False,
    Prioritize_Entropy_Rate=False,
    Prioritize_ForceSet=True,
    Show_Interim_Force_Labels=False,
    Show_Axial_Force_Labels=False,
    Show_Bar_Labels=False,
    Show_Node_Labels=True,
    fa=True)

# ----
# transform model
number_slider_4 = Slider(1, range=1..10)
# ITERATION #4
transform_4 = ApplyTransformationPolicy(
    Iterations=number_slider_4,
    Model=transform_3,
    Policy=policy_10,
    Clean_Model=False,
    Prioritize_Entropy_Rate=False,
    Prioritize_ForceSet=True,
    Show_Interim_Force_Labels=False,
    Show_Axial_Force_Labels=False,
    Show_Bar_Labels=False,
    Show_Node_Labels=True,
    fa=True)

# ----
# transform model
number_slider_5 = Slider(1, range=1..10)
# ITERATION #5
transform_5 = ApplyTransformationPolicy(
    Iterations=number_slider_5,
    Model=transform_4,
    Policy=policy_11,
    Clean_Model=False,
    Prioritize_Entropy_Rate=False,
    Prioritize_ForceSet=True,
    Show_Interim_Force_Labels=False,
    Show_Axial_Force_Labels=False,
    Show_Bar_Labels=False,
    Show_Node_Labels=True,
    fa=True)

# ----
# transform model
number_slider_6 = Slider(1, range=1..10)
# ITERATION #6
transform_6 = ApplyTransformationPolicy(
    Iterations=number_slider_6,
    Model=transform_5,
    Policy=policy_7,
    Clean_Model=False,
    Prioritize_Entropy_Rate=False,
    Prioritize_ForceSet=True,
    Show_Interim_Force_Labels=False,
    Show_Axial_Force_Labels=False,
    Show_Bar_Labels=False,
    Show_Node_Labels=True,
    fa=True)

# ----
# turn component preview ON to see forces ID
panel = Panel("3")
int = Integer(panel)
int_2 = Integer("0")
selectforce = SelectForce(Model=transform_6, Identifier=int, Show_Interim_Force_Labels=True)  # -> ForceObject, ForceName, AnchorNodeObject, ForceDirection, ForceMagnitude
selectforce_2 = SelectForce(Model=transform_6, Identifier=int_2, Show_Interim_Force_Labels=True)  # -> ForceObject, ForceName, AnchorNodeObject, ForceDirection, ForceMagnitude

# ----
# explicit forceset selection
topological_configuration_13 = ValueList({"Inbetween": 0, "Peripheral": 1}, selected="Inbetween")
entropy_rate_13 = ValueList({"Convergence": -1, "Stagnation": 0, "Divergence": 1}, selected="Divergence")
constructforceset = ConstructForceSet(
    EntropyRate=entropy_rate_13,
    TopologicalConfiguration=topological_configuration_13,
    Model=transform_6,
    ForceObjectS=[selectforce.ForceObject, selectforce_2.ForceObject],
    TransformationConstraint=constraint,
    Hatch_rotation_in_radians=0.25,
    Hatch_scale_as_double=3,
    Segment_thickness_as_integer=3,
    toggle1=False,
    toggle2=False,
    toggle3=False)  # -> IsValid, ForceSet, EntropyRateDomain, ConstructabilityDomain, ConstrainedDomain

# ----
# entR defined above
# consider the warning (orange)
# define policy
genes_13 = GenePool(Decimals=2, Maximum=1, Minimum=-1, Value=[0.71, 1])
force_indeterminacies_rule_13 = ValueList({"Random": 0, "UserDefinedMagnitude": 1}, selected="UserDefinedMagnitude")
multiplication_13 = Multiplication(A=genes_13, B=Slider(5, range=0..10))
forceirule_13 = ConstructForceIndeterminaciesRule(ForceIndeterminaciesRuleID=force_indeterminacies_rule_13, Forces=multiplication_13)
policy_13 = ConstructTransformationPolicy(
    EntropyRate=entropy_rate_13,
    ForceSelectionRuleForcesSet=constructforceset.ForceSet,
    NodePlacementRulePoint=nodeprule_13,
    ForceIndeterminaciesRuleAxialForces=forceirule_13,
    TransformationConstraints=constraint)

# ----
# confirm that indicated entropy rate is feasible
panel_2 = Panel(constructforceset.IsValid)

# ----
# transform model
number_slider_7 = Slider(1, range=1..10)
# ITERATION #7
transform_7 = ApplyTransformationPolicy(
    Iterations=number_slider_7,
    Model=transform_6,
    Policy=policy_13,
    Clean_Model=False,
    Prioritize_Entropy_Rate=False,
    Prioritize_ForceSet=True,
    Show_Interim_Force_Labels=False,
    Show_Axial_Force_Labels=False,
    Show_Bar_Labels=False,
    Show_Node_Labels=True,
    fa=True)

# ----
# transform model
number_slider_8 = Slider(1, range=1..10)
# ITERATION #8
transform_8 = ApplyTransformationPolicy(
    Iterations=number_slider_8,
    Model=transform_7,
    Policy=policy_6,
    Clean_Model=False,
    Prioritize_Entropy_Rate=False,
    Prioritize_ForceSet=True,
    Show_Interim_Force_Labels=False,
    Show_Axial_Force_Labels=False,
    Show_Bar_Labels=False,
    Show_Node_Labels=True,
    fa=True)

# ----
# transform model
number_slider_9 = Slider(1, range=1..10)
# ITERATION #9
transform_9 = ApplyTransformationPolicy(
    Iterations=number_slider_9,
    Model=transform_8,
    Policy=policy_4,
    Clean_Model=False,
    Prioritize_Entropy_Rate=False,
    Prioritize_ForceSet=True,
    Show_Interim_Force_Labels=False,
    Show_Axial_Force_Labels=False,
    Show_Bar_Labels=False,
    Show_Node_Labels=True,
    fa=True)

# ----
# transform model
number_slider_10 = Slider(1, range=1..10)
# ITERATION #10
transform_10 = ApplyTransformationPolicy(
    Iterations=number_slider_10,
    Model=transform_9,
    Policy=policy_5,
    Clean_Model=False,
    Prioritize_Entropy_Rate=False,
    Prioritize_ForceSet=True,
    Show_Interim_Force_Labels=False,
    Show_Axial_Force_Labels=False,
    Show_Bar_Labels=False,
    Show_Node_Labels=True,
    fa=True)

# ----
# transform model
number_slider_11 = Slider(1, range=1..10)
# ITERATION #11
transform_11 = ApplyTransformationPolicy(
    Iterations=number_slider_11,
    Model=transform_10,
    Policy=policy,
    Clean_Model=False,
    Prioritize_Entropy_Rate=False,
    Prioritize_ForceSet=True,
    Show_Interim_Force_Labels=False,
    Show_Axial_Force_Labels=False,
    Show_Bar_Labels=False,
    Show_Node_Labels=True,
    fa=True)

# ----
# transform model
number_slider_12 = Slider(1, range=1..10)
# ITERATION #12
transform_12 = ApplyTransformationPolicy(
    Iterations=number_slider_12,
    Model=transform_11,
    Policy=policy_2,
    Clean_Model=False,
    Prioritize_Entropy_Rate=False,
    Prioritize_ForceSet=True,
    Show_Interim_Force_Labels=False,
    Show_Axial_Force_Labels=False,
    Show_Bar_Labels=False,
    Show_Node_Labels=True,
    fa=True)

# ----
# transform model
number_slider_13 = Slider(1, range=1..10)
# ITERATION #12
transform_13 = ApplyTransformationPolicy(
    Iterations=number_slider_13,
    Model=transform_12,
    Policy=policy_3,
    Clean_Model=False,
    Prioritize_Entropy_Rate=False,
    Prioritize_ForceSet=True,
    Show_Interim_Force_Labels=False,
    Show_Axial_Force_Labels=False,
    Show_Bar_Labels=False,
    Show_Node_Labels=True,
    fa=True)

# ----
# model
# network
modelnetwork = ModelNetwork(Model=transform_13)  # -> Nodes, Valency, Bars, AxialForces, NN, NE, EE, EN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
panel_3 = Panel(modelnetwork.AxialForces)
panel_4 = Panel(modelnetwork.NN)
panel_5 = Panel(modelnetwork.NE)

# ----
# GROUP I : POST PROCESSING
# replace model bar by forces
number_slider_14 = Slider(10, range=0..10)
int_3 = Integer(number_slider_14)
selectreplacebar = SelectBarReplace(
    Model=transform_13,
    BarIdentifier=int_3,
    Show_Interim_Force_Labels=False,
    Show_Axial_Force_Labels=False,
    Show_Bar_Labels=True,
    Show_Node_Labels=True)

# ----
# model undo
# GROUP II: HISTORY
number_slider_15 = Slider(0, range=0..13)
undomodel = ModelUndo(
    Model=transform_13,
    Step=number_slider_15,
    Show_Interim_Force_Labels=False,
    Show_Axial_Force_Labels=False,
    Show_Bar_Labels=False,
    Show_Node_Labels=True)

# ----
# GROUP IV: VISUALIZATION
# model to GH geometry
number_slider_16 = Slider(0.25, range=0..3)
modelgeometry = ModelGeometry(Model=transform_13, NodalRadius=number_slider_16, ForceScale=Slider(1, range=0..3))  # -> Nodes, ForcesExt, ForcesInt, BarsCompression, BarsTension

# ----
# desired VS applied entR
# transformation policies history
modelhistory = ModelHistory(Model=transform_13, Iteration=-1)  # -> Rule_ForceS, Rule_NodeP, Rule_ForceI, Rule_EntR_des, Rule_EntR_app, ForceSet, Point, ForceIndeterminacies, Force
panel_6 = Panel(modelhistory.Rule_EntR_des)
panel_7 = Panel(modelhistory.Rule_EntR_app)

# ----
# model metrics
modelmetrics = ModelMetricsText(Model=transform_13)  # -> AllMetrics, StaticAction, NumberOfBars, NumberOfNodes, NumberOfIntersectingBars, NumberOfInterimForces, MinBarLength, MaxBarLength, MinForceMagnitude, MaxForceMagnitude
# GROUP III: METRICS & ANALYSIS
panel_8 = Panel(modelmetrics.AllMetrics)

# ----
# model metrics (spider graph)
genes_14 = GenePool(Decimals=2, Maximum=5, Minimum=0, Value=[2.5, 2.5, 2.5, 1.5, 2.5, 1.5, 5, 2.5])
pt_12 = Point(<point referenced from the Rhino model>)
xy = XYPlane(Origin=pt_12)
modelspidergraph = ModelMetricsSpiderGraph(
    Model=transform_13,
    GraphPlane=xy,
    GraphWeight=genes_14,
    GraphScale=Slider(1.3, range=0.5..2),
    TextHeight=Slider(0.6, range=0..1),
    VerticalDistance=Slider(0.5, range=0.1..1.1),
    RadialDistance=Slider(0.2, range=0..1))  # -> GraphLines, MetricsLine, Text
brep = Brep(modelspidergraph.MetricsLine)
preview = CustomPreview(Geometry=brep, Material=ColourSwatch(SwatchColor=RGB(0, 255, 255)))

# ---- group: AXIAL FORCES
num = Number(modelnetwork.AxialForces)

# ---- group: bars in C
data = Data(modelgeometry.BarsCompression)

data_2 = Data(modelgeometry.BarsTension)

# ----
# ASSUMPTION:
# compression: blue & positive
# tension: red & negative
# model piped structure
panel_9 = Panel("0")
larger = LargerThan(FirstNumber=modelnetwork.AxialForces, SecondNumber=panel_9)  # -> LargerThan, OrEqualTo
data_3 = Data(larger.LargerThan)
dispatch = Dispatch(List=num, DispatchPattern=data_3)  # -> ListA, ListB
number_slider_17 = Slider(0.066, range=0..1)
abs = Absolute(Value=dispatch.ListB)
multiplication_14 = Multiplication(A=dispatch.ListA, B=number_slider_17)
multiplication_15 = Multiplication(A=abs, B=number_slider_17)
pipe = Pipe(Curve=data, Radius=multiplication_14, Caps=0)  # -> flatten(Pipe)
pipe_2 = Pipe(Curve=data_2, Radius=multiplication_15, Caps=0)  # -> flatten(Pipe)

preview_2 = CustomPreview(Geometry=pipe, Material=ColourSwatch(SwatchColor=RGBA(68, 113, 255, 185)))
preview_3 = CustomPreview(Geometry=pipe_2, Material=ColourSwatch(SwatchColor=RGBA(255, 0, 0, 133)))
