# Grasshopper definition simple_cantilever [completed].gh (Grasshopper 1.0.8)
# plug-ins: LibraGH

crv = Curve(<curve referenced from the Rhino model>)
pt = Point(<point referenced from the Rhino model>)
pt_2 = Point(<point referenced from the Rhino model>)
pt_3 = Point(<point referenced from the Rhino model>)
pt_4 = Point(<point referenced from the Rhino model>)
pt_5 = Point(<point referenced from the Rhino model>)
pt_6 = Point(<point referenced from the Rhino model>)
vec2pt = Vector2Pt(PointA=pt, PointB=pt_2, Unitize=False)  # -> Vector, Length
vec2pt_2 = Vector2Pt(PointA=pt_3, PointB=pt_4, Unitize=False)  # -> Vector, Length
vec2pt_3 = Vector2Pt(PointA=pt_5, PointB=pt_6, Unitize=False)  # -> Vector, Length
constructdomain = ConstructDomain(RegionsIn=crv)
merge = Merge(Data1=pt_2, Data2=pt_3, Data3=pt_6)
merge_2 = Merge(Data1=vec2pt.Vector, Data2=vec2pt_2.Vector, Data3=vec2pt_3.Vector)
constructmodel = ConstructModel(AnchorPoint=merge, ForceVector=merge_2, DesignDomain=constructdomain)
genes = GenePool(Decimals=0, Maximum=12, Minimum=2, Value=[4, 3, 4, 3, 2, 2, 3, 3, 2, 2])
genes_2 = GenePool(Decimals=2, Maximum=1, Minimum=0, Value=[0.35, 0.51, 0.64, 0.22, 0.42, 0.31, 0.48, 0.1, 0.22, 0.44])
genes_3 = GenePool(
    Decimals=2,
    Maximum=1,
    Minimum=-1,
    Value=[-0.02, -0.4, -0.03, -0.2, 0.19, -0.1, -0.37, -0.41, -0.33, -0.1, -0.41, -0.13, -0.26, -0.05, -0.01, 0.22, -0.2, -0.35, -0.6, -0.43])
genes_4 = GenePool(Decimals=2, Maximum=0.001, Minimum=0, Value=[0.0005, 0.0005])

transformation_constraint = ValueList({"BarLengths": 0, "EqualBarLengths": 1}, selected="BarLengths")
constraint = ConstructTransformationConstraint(
    TransformationConstraintID=transformation_constraint,
    MinimumLength=Slider(3, range=0..10),
    MaximumLength=Slider(15, range=0..20))

multiplication = Multiplication(A=genes_4, B=Slider(15, range=0..20))

multiplication_2 = Multiplication(A=genes_3, B=Slider(15, range=0..20))

force_s_selection_rule = ValueList({"Random": 0, "ProximityToUserSelectedPoint": 1, "MinMagnitude": 2, "MaxMagnitude": 3, "Oldest": 4, "Newest": 5, "Oldest_Newest_Bi": 6, "Closest": 7, "Furthest": 8, "ClosestToDomainCentroid": 9, "FurthestToDomainCentroid": 10, "ClosestToPtCloud": 11, "FurthestToPtCloud": 12, "IndexExplicit": 13, "ManuallyExplicit": 14}, selected="Newest")
force_indeterminacies_rule = ValueList({"Random": 0, "UserDefinedMagnitude": 1}, selected="UserDefinedMagnitude")
node_placement_rule = ValueList({"Random": 0, "UserSelectedParam": 1, "UserSelectedPt": 2, "ClosestPossible": 3, "FurthestPossible": 4, "NoNode": 5}, selected="NoNode")
topological_configuration = ValueList({"Inbetween": 0, "Peripheral": 1}, selected="Inbetween")
type_of_force_set = ValueList({"Monomial": 0, "Binomial": 1}, selected="Monomial")
forcesrule = ConstructForceSelectionRule(
    ForceSelectionRuleID=force_s_selection_rule,
    TypeOfForceSet=type_of_force_set,
    TopologicalConfiguration=topological_configuration,
    FlipForcesOrder=Toggle(False))
nodeprule = ConstructNodePlacementRule(NodePlacementRuleID=node_placement_rule, MinDistanceToModel=Slider(0.25, range=0..1), TParam=Slider(0.783, range=0..1))
forceirule = ConstructForceIndeterminaciesRule(ForceIndeterminaciesRuleID=force_indeterminacies_rule, Forces=multiplication)
entropy_rate = ValueList({"Convergence": -1, "Stagnation": 0, "Divergence": 1}, selected="Convergence")
policy = ConstructTransformationPolicy(
    EntropyRate=entropy_rate,
    ForceSelectionRuleForcesSet=forcesrule,
    NodePlacementRulePoint=nodeprule,
    ForceIndeterminaciesRuleAxialForces=forceirule,
    TransformationConstraints=constraint)
transform = ApplyTransformationPolicy(
    Iterations=Slider(1, range=1..20),
    Model=constructmodel,
    Policy=policy,
    Clean_Model=False,
    Prioritize_Entropy_Rate=False,
    Prioritize_ForceSet=True,
    Show_Interim_Force_Labels=False,
    Show_Axial_Force_Labels=False,
    Show_Bar_Labels=False,
    Show_Node_Labels=True,
    fa=True)

force_indeterminacies_rule_2 = ValueList({"Random": 0, "UserDefinedMagnitude": 1}, selected="UserDefinedMagnitude")
node_placement_rule_2 = ValueList({"Random": 0, "UserSelectedParam": 1, "UserSelectedPt": 2, "ClosestPossible": 3, "FurthestPossible": 4, "NoNode": 5}, selected="UserSelectedParam")
topological_configuration_2 = ValueList({"Inbetween": 0, "Peripheral": 1}, selected="Inbetween")
type_of_force_set_2 = ValueList({"Monomial": 0, "Binomial": 1}, selected="Binomial")
forcesrule_2 = ConstructForceSelectionRule(
    ForceSelectionRuleID=genes,
    TypeOfForceSet=type_of_force_set_2,
    TopologicalConfiguration=topological_configuration_2,
    FlipForcesOrder=Toggle(False))
nodeprule_2 = ConstructNodePlacementRule(NodePlacementRuleID=node_placement_rule_2, MinDistanceToModel=Slider(0.25, range=0..1), TParam=genes_2)
forceirule_2 = ConstructForceIndeterminaciesRule(ForceIndeterminaciesRuleID=force_indeterminacies_rule_2, Forces=multiplication_2)
entropy_rate_2 = ValueList({"Convergence": -1, "Stagnation": 0, "Divergence": 1}, selected="Convergence")
policy_2 = ConstructTransformationPolicy(
    EntropyRate=entropy_rate_2,
    ForceSelectionRuleForcesSet=forcesrule_2,
    NodePlacementRulePoint=nodeprule_2,
    ForceIndeterminaciesRuleAxialForces=forceirule_2,
    TransformationConstraints=constraint)
transform_2 = ApplyTransformationPolicy(
    Iterations=Slider(10, range=1..10),
    Model=transform,
    Policy=policy_2,
    Clean_Model=False,
    Prioritize_Entropy_Rate=False,
    Prioritize_ForceSet=True,
    Show_Interim_Force_Labels=False,
    Show_Axial_Force_Labels=False,
    Show_Bar_Labels=False,
    Show_Node_Labels=True,
    fa=True)

panel = Panel(policy)
panel_2 = Panel(policy_2)
