# Grasshopper definition symmetric_arch [completed].gh (Grasshopper 1.0.8)
# plug-ins: LibraGH

# ----
# DEFINE DESIGN DOMAIN
number_slider = Slider(5, range=0..10)
crv = Curve(<curve referenced from the Rhino model>)
curvetesselation = CurveTesselation(Curve=crv, Divisions=number_slider)
constructdomain = ConstructDomain(RegionsIn=curvetesselation)
curveconvexity = CurveConvexity(Curve=curvetesselation)
panel = Panel(curveconvexity)
panel_2 = Panel(constructdomain)

pt = Point(<point referenced from the Rhino model>)
pt_2 = Point(<point referenced from the Rhino model>)
pt_3 = Point(<point referenced from the Rhino model>)
pt_4 = Point(<point referenced from the Rhino model>)
pt_5 = Point(<point referenced from the Rhino model>)
pt_6 = Point(<point referenced from the Rhino model>)
pt_7 = Point(<point referenced from the Rhino model>)
pt_8 = Point(<point referenced from the Rhino model>)
pt_9 = Point(<point referenced from the Rhino model>)
pt_10 = Point(<point referenced from the Rhino model>)
pt_11 = Point(<point referenced from the Rhino model>)
pt_12 = Point(<point referenced from the Rhino model>)
vec2pt = Vector2Pt(PointA=pt, PointB=pt_2, Unitize=False)  # -> Vector, Length
vec2pt_2 = Vector2Pt(PointA=pt_3, PointB=pt_4, Unitize=False)  # -> Vector, Length
vec2pt_3 = Vector2Pt(PointA=pt_5, PointB=pt_6, Unitize=False)  # -> Vector, Length
vec2pt_4 = Vector2Pt(PointA=pt_7, PointB=pt_8, Unitize=False)  # -> Vector, Length
vec2pt_5 = Vector2Pt(PointA=pt_9, PointB=pt_10, Unitize=False)  # -> Vector, Length
vec2pt_6 = Vector2Pt(PointA=pt_11, PointB=pt_12, Unitize=False)  # -> Vector, Length
merge = Merge(Data1=pt_2, Data2=pt_4, Data3=pt_6, Data4=pt_8, Data5=pt_10, Data6=pt_12)
merge_2 = Merge(
    Data1=vec2pt.Vector,
    Data2=vec2pt_2.Vector,
    Data3=vec2pt_3.Vector,
    Data4=vec2pt_4.Vector,
    Data5=vec2pt_5.Vector,
    Data6=vec2pt_6.Vector)
constructmodel = ConstructModel(AnchorPoint=merge, ForceVector=merge_2, DesignDomain=constructdomain)
genes = GenePool(Decimals=0, Maximum=12, Minimum=2, Value=[5, 9, 7, 4, 6, 9, 6, 7, 3, 5, 4, 4, 7, 8, 4, 4, 4, 4, 6, 7])
genes_2 = GenePool(Decimals=0, Maximum=1, Minimum=0, Value=[0, 0, 0, 0, 0, 0, 0, 0, 0, 0, 0, 0, 0, 0, 0, 0, 0, 0, 0, 0])
genes_3 = GenePool(
    Decimals=2,
    Maximum=1,
    Minimum=0,
    Value=[0.64, 0.46, 0.34, 0.62, 0.44, 0.27, 0.49, 0.38, 0.45, 0.42, 0.38, 0.74, 0.43, 0.64, 0.12, 0.28, 0.39, 0.74, 0.29, 0.5])
genes_4 = GenePool(Decimals=2, Maximum=1, Minimum=-1, Value=[0.46, 0.06, 0.15, -0.37, -0.19, -0.27, -0.19, -0.54, 0.1, -0.29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])

# ---- group: Transformation Policy Parameters
transformation_constraint = ValueList({"BoundedBarLengths": 0, "PredefinedBars": 1}, selected="BoundedBarLengths")
force_indeterminacies_rule = ValueList({"Random": 0, "UserDefinedMagnitude": 1}, selected="UserDefinedMagnitude")
node_placement_rule = ValueList({"Random": 0, "UserSelectedParam": 1, "UserSelectedPt": 2, "ClosestPossible": 3, "FurthestPossible": 4, "NoNode": 5}, selected="UserSelectedParam")
topological_configuration = ValueList({"Inbetween": 0, "Peripheral": 1}, selected="Inbetween")
type_of_force_set = ValueList({"Monomial": 0, "Binomial": 1}, selected="Binomial")
multiplication = Multiplication(A=genes_4, B=Slider(5, range=0..10))
constraint = ConstructTransformationConstraint(
    TransformationConstraintID=transformation_constraint,
    MinimumLength=Slider(2, range=1..15),
    MaximumLength=Slider(12, range=1..15))
forcesrule = ConstructForceSelectionRule(
    ForceSelectionRuleID=genes,
    TypeOfForceSet=type_of_force_set,
    TopologicalConfiguration=topological_configuration,
    FlipForcesOrder=genes_2)
nodeprule = ConstructNodePlacementRule(NodePlacementRuleID=node_placement_rule, MinDistanceToModel=Slider(0.25, range=0..1), TParam=genes_3)
forceirule = ConstructForceIndeterminaciesRule(ForceIndeterminaciesRuleID=force_indeterminacies_rule, Forces=multiplication)
entropy_rate = ValueList({"Convergence": -1, "Stagnation": 0, "Divergence": 1}, selected="Convergence")
policy = ConstructTransformationPolicy(
    EntropyRate=entropy_rate,
    ForceSelectionRuleForcesSet=forcesrule,
    NodePlacementRulePoint=nodeprule,
    ForceIndeterminaciesRuleAxialForces=forceirule,
    TransformationConstraint=constraint)

# ----
panel_3 = Panel(policy)
pt_13 = Point(<point referenced from the Rhino model>)
number_slider_2 = Slider(0.75, range=0..3)
transform = ApplyTransformationPolicy(
    Iterations=Slider(20, range=1..20),
    Model=constructmodel,
    Policy=policy,
    Clean_Model=False,
    Prioritize_Entropy_Rate=False,
    Prioritize_ForceSet=True,
    Show_Interim_Force_Labels=False,
    Show_Axial_Force_Labels=False,
    Show_Bar_Labels=False,
    Show_Node_Labels=True,
    fa=True)
yz = YZPlane(Origin=pt_13)
modelgeometry = ModelGeometry(Model=transform, MirrorPlane=yz, NodalRadius=number_slider_2, ForceScale=Slider(1, range=0..3))  # -> flatten(Nodes), ForcesExt, ForcesInt, BarsCompression, BarsTension
modelmetrics = ModelMetricsText(Model=transform)  # -> AllMetrics, StaticAction, NumberOfBars, NumberOfNodes, NumberOfIntersectingBars, NumberOfInterimForces, MinBarLength, MaxBarLength, MinForceMagnitude, MaxForceMagnitude

# ----
# Ext Forces
number_slider_3 = Slider(5, range=0..10)
lng = ListLength(List=merge_2)
addition = Addition(A=number_slider_3, B=lng)
merge_3 = Merge(Data1=number_slider_3, Data2=addition)  # -> flatten(Result)
cull_i = CullIndex(List=modelgeometry.ForcesExt, Indices=merge_3, Wrap=True)
end = EndPoints(Curve=cull_i)  # -> Start, End
number_slider_4 = Slider(1.5, range=0..3)
vec2pt_7 = Vector2Pt(PointA=end.Start, PointB=end.End, Unitize=False)  # -> Vector, Length
unit = UnitVector(Vector=vec2pt_7.Vector)
multiplication_2 = Multiplication(A=unit, B=number_slider_4)
move = Move(Geometry=end.End, Motion=expr("-x", multiplication_2))  # -> Geometry, Transform
pl = PlaneNormal(Origin=move.Geometry, ZAxis=vec2pt_7.Vector)
number_slider_5 = Slider(0.396, range=0..1)
ln = Line(StartPoint=end.Start, EndPoint=move.Geometry)
expression = Expression(x=number_slider_5, Expression="3*x/2")
cone = Cone(Base=pl, Radius=expression, Length=number_slider_4)  # -> Cone, Tip
pipe = Pipe(Curve=ln, Radius=number_slider_5, Caps=0)  # -> flatten(Pipe)
preview = CustomPreview(Geometry=[cone.Cone, pipe], Material=ColourSwatch(SwatchColor=RGBA(2, 255, 0, 137)))

modelnetwork = ModelNetwork(Model=transform)  # -> Nodes, Valency, Bars, AxialForces, NN, NE, EE, EN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
int = Integer(modelmetrics.NumberOfIntersectingBars)
int_2 = Integer(modelmetrics.NumberOfInterimForces)
addition_2 = Addition(A=int, B=int_2)
galapagos = Galapagos(fitness=addition_2, gene=[genes, genes_2, genes_3, genes_4])

# ----
# Bars T/C
panel_4 = Panel("0")
larger = LargerThan(FirstNumber=modelnetwork.AxialForces, SecondNumber=panel_4)  # -> LargerThan, OrEqualTo
dispatch = Dispatch(List=modelnetwork.Bars, DispatchPattern=larger.LargerThan)  # -> ListA, ListB
dispatch_2 = Dispatch(List=modelnetwork.AxialForces, DispatchPattern=larger.LargerThan)  # -> ListA, ListB
number_slider_6 = Slider(0.04, range=0..1)
abs = Absolute(Value=dispatch_2.ListB)
multiplication_3 = Multiplication(A=dispatch_2.ListA, B=number_slider_6)
multiplication_4 = Multiplication(A=abs, B=number_slider_6)
pipe_2 = Pipe(Curve=dispatch.ListA, Radius=multiplication_3, Caps=0)  # -> flatten(Pipe)
pipe_3 = Pipe(Curve=dispatch.ListB, Radius=multiplication_4, Caps=0)  # -> flatten(Pipe)
mirror = Mirror(Geometry=pipe_2, Plane=yz)  # -> Geometry, Transform
mirror_2 = Mirror(Geometry=pipe_3, Plane=yz)  # -> Geometry, Transform
flip = Flip(Surface=mirror.Geometry)  # -> Surface, Result
flip_2 = Flip(Surface=mirror_2.Geometry)  # -> Surface, Result
merge_4 = Merge(Data1=pipe_2, Data2=flip.Surface)
merge_5 = Merge(Data1=flip_2.Surface, Data2=pipe_3)
preview_2 = CustomPreview(Geometry=merge_4, Material=ColourSwatch(SwatchColor=RGBA(68, 113, 255, 185)))
preview_3 = CustomPreview(Geometry=merge_5, Material=ColourSwatch(SwatchColor=RGBA(255, 0, 0, 133)))

# ----
# Nodes
number_slider_7 = Slider(5, range=0..10)
addition_3 = Addition(A=number_slider_7, B=modelmetrics.NumberOfNodes)
merge_6 = Merge(Data1=number_slider_7, Data2=addition_3)  # -> flatten(Result)
cull_i_2 = CullIndex(List=modelgeometry.Nodes, Indices=merge_6, Wrap=True)
sph = Sphere(Base=cull_i_2, Radius=number_slider_2)
preview_4 = CustomPreview(Geometry=sph, Material=ColourSwatch(SwatchColor=RGB(0, 0, 36)))
